# Grasshopper definition (Additional) PV Solar Potential Framework + DEM.gh (Grasshopper 1.0.8)
# plug-ins: RhinoCodePluginGH, MeshEdit Components, Pufferfish, NGon, LunchBox

# ----
# Coordinates GT Campus
panel = Panel("-84.40251, 33.77340, -84.39399, 33.77852")

# ----
# Coordinates Solar Study Test 1
panel_2 = Panel("-84.37984, 33.77699, -84.37850, 33.77819")

pointcloud_crs = Integer("6350")

out_crs = Integer("26916")

temp_path = Text("D:\GATECH\HPBL\Data\Lidar\")

split = TextSplit(Text=panel_2, Separators=",")
num = Number(split)
item = ListItem(List=num, Index=0, Wrap=True)  # -> Item, Item1, Item2, Item3
temp_path_2 = Text(temp_path)
out_crs_2 = Integer(out_crs)
xmin = Number(item.Item)
# Instructions for installing
# packages
# Go to
# C:\Users\%UserName%\.rhinocode\py39-rh8\Scripts
# 
# with command prompt run:
# 
# cd "C:\Users\%UserName%\.rhinocode\py39-rh8\Scripts"
# 
# to install packages:
# 
# pip install laspy[lazrs,laszip]
# pip install geopy
# pip install scikit-learn
# pip install scipy
# pip install cgal
# pip install requests
# pip install rasterio
# pip install laspy
# pip install geopandas
# pip install osmnx
# 
# Close Rhino
# 
# Open Rhino and, before starting Grashopper, run ScriptEditor command and run
# 
# import locale
# locale.setlocale(locale.LC_ALL, 'en_US')
# import pandas as pd
# import laspy
xmin_2 = Number(xmin)
tstat = TreeStatistics(Tree=xmin_2)  # -> Paths, Length, Count
dpath = DeconstructPath(Branch=tstat.Paths)
item_2 = ListItem(List=dpath, Index=0, Wrap=True)
ymin = Number(item.Item1)
ymin_2 = Number(ymin)
xmax = Number(item.Item2)
xmax_2 = Number(xmax)
ymax = Number(item.Item3)

# ----
# Visualize Study Bounding Box
xmin_3 = Number(xmin)
ymin_3 = Number(ymin)
xmax_3 = Number(xmax)
ymax_2 = Number(ymax)
out_crs_3 = Integer(out_crs)
bbox = Script(xmin=xmin_3, ymin=ymin_3, xmax=xmax_3, ymax=ymax_2, out_crs=out_crs_3)  # -> bbox; inputs xmin: Double, ymin: Double, xmax: Double, ymax: Double
# ---------- bbox: Python ----------
import requests
import json
import geopandas as gpd
import os 
import rhinoscriptsyntax as rs
from pyproj import Transformer
import numpy as np

points =np.array([[xmin, ymin],
                  [xmax, ymin],
                  [xmax, ymax],
                  [xmin, ymax],
                  [xmin, ymin]])

transformer = Transformer.from_crs(crs_from="EPSG:4326", crs_to=f"EPSG:{out_crs}")

points0_t, points1_t = transformer.transform(points[:,1], points[:,0])

bbox = rs.AddPolyline([rs.AddPoint(points0_t[0], points1_t[0]),
                       rs.AddPoint(points0_t[1], points1_t[1]),
                       rs.AddPoint(points0_t[2], points1_t[2]),
                       rs.AddPoint(points0_t[3], points1_t[3]),
                       rs.AddPoint(points0_t[0], points1_t[0])])

print(points0_t[0], points1_t[0], points0_t[2], points1_t[2])
# ---------- end bbox ----------
item_3 = ListItem(List=flatten(bbox), Index=0, Wrap=True)
drec = DeconstuctRectangle(Rectangle=item_3)  # -> BasePlane, XInterval, YInterval
pt = Point(drec.BasePlane)
pt_2 = Point(Point(0, 0, 0))
vec2pt = Vector2Pt(PointA=pt, PointB=pt_2, Unitize=False)  # -> Vector, Length
move = Move(Geometry=bbox, Motion=vec2pt.Vector)  # -> Geometry, Transform
translation = Vector(vec2pt.Vector)
bbox_2 = Curve(move.Geometry)

ymax_3 = Number(ymax)

# ----
# Request OSM
# Footprints
buildings_osm = Script(xmin=xmin_2, ymin=ymin_2, xmax=xmax_2, ymax=ymax_3, temp_path=temp_path_2, out_crs=out_crs_2, tree_level=item_2)  # -> buildings, footprints, locations, xmin_new, ymin_new, xmax_new, ymax_new; inputs xmin: Double, ymin: Double, xmax: Double, ymax: Double, temp_path: String, tree_level: Int32
# ---------- buildings_osm: Python ----------
import requests
import json
import geopandas as gpd
import os 
import rhinoscriptsyntax as rs
from pyproj import Transformer
import ghpythonlib.treehelpers as th
import osmnx as ox

ox.config(use_cache=True, cache_folder=temp_path + "osm_cache")

def request_data_by_bbox(xmin, ymin, xmax, ymax, out_crs):
    tags = {"building": True}
    print(type(tags))
    result = ox.features.features_from_bbox(ymax, ymin, xmax, xmin, tags=tags)
    return result.to_crs(out_crs)

file_name = temp_path + f'EPSG{out_crs} - {xmin}, {ymin}, {xmax}, {ymax} ' + 'OSM_buildings.json'

if os.path.isfile(file_name):
    buildings = gpd.read_file(file_name, driver="GeoJSON")
else:
    buildings_gpd = request_data_by_bbox(xmin, ymin, xmax, ymax, out_crs)
    buildings_gpd[["geometry"]].to_file(file_name, driver="GeoJSON")

    buildings = gpd.read_file(file_name)
    buildings = buildings.to_crs(out_crs)

footprints = []
locations = []

for i in range(buildings.shape[0]):
    footprint = []
    building = buildings.iloc[i]
    if building.geometry.type == "Point": continue
    if building.geometry.type == "MultiPolygon": 
        for geo in building.geometry.geoms:
            exterior = rs.AddPolyline([rs.AddPoint(coord[0], coord[1], ) for coord in geo.exterior.coords])
            footprint.append(exterior)
            
            for interior in geo.interiors:
                footprint.append(rs.AddPolyline([rs.AddPoint(coord[0], coord[1], ) for coord in interior.coords]))
            
        
        footprints.append(footprint)
        continue
    exterior = rs.AddPolyline([rs.AddPoint(coord[0], coord[1], ) for coord in building.geometry.exterior.coords])
    footprint.append(exterior)
    
    for interior in buildings.iloc[i].geometry.interiors:
        footprint.append(rs.AddPolyline([rs.AddPoint(coord[0], coord[1], ) for coord in interior.coords]))
    
    footprints.append(footprint)

    transformer_loc = Transformer.from_crs(f"EPSG:{out_crs}", "EPSG:4326", always_xy=True)
    location = transformer_loc.transform(building.geometry.centroid.x, building.geometry.centroid.y)
    locations.append([location[0], location[1]])



transformer = Transformer.from_crs("EPSG:4326", f"EPSG:{out_crs}", always_xy=True)

xmin_t, ymin_t = transformer.transform(xmin, ymin)
xmax_t, ymax_t = transformer.transform(xmax, ymax)

xmin_t = xmin_t# - 70
ymin_t = ymin_t# - 70
xmax_t = xmax_t# + 70
ymax_t = ymax_t# + 70

transformer = Transformer.from_crs(f"EPSG:{out_crs}", "EPSG:4326", always_xy=True)

xmin_new, ymin_new = transformer.transform(xmin_t, ymin_t)
xmax_new, ymax_new = transformer.transform(xmax_t, ymax_t)

footprints = th.list_to_tree(footprints, source=[tree_level])
locations = th.list_to_tree(locations, source=[tree_level])
# ---------- end buildings_osm ----------

translation_2 = Vector(translation)
move_2 = Move(Geometry=buildings_osm.footprints, Motion=translation_2)  # -> Geometry, Transform
bbox_3 = Curve(bbox_2)
colom = CollisionOneMany(Collider=bbox_3, Obstacles=move_2.Geometry)  # -> Collision, Index
cull = CullPattern(List=move_2.Geometry, CullPattern=invert(colom.Collision))
clean = CleanTree(RemoveNulls=True, RemoveInvalid=True, RemoveEmpty=invert(False), Tree=cull)  # -> simplify(Tree)
tstat_2 = TreeStatistics(Tree=clean)  # -> Paths, Length, Count
branch = TreeBranch(Tree=simplify(buildings_osm.locations), Path=tstat_2.Paths, MaintainPaths=False)
footprints = Curve(move_2.Geometry)
geo_locations = Number(branch)

# ---- group: DEKALB
path = FilePath("D:\GATECH\HPBL\Honeybee\USA_GA_DeKalb-Peachtree.AP.722196_TMY3.epw")

# ---- group: NREL
path_2 = FilePath("D:\GATECH\HPBL\Honeybee\Atlanta_33.77_-84.3824_2021.epw")

# ----
importepw = LBImportEPW(epw_file=path)  # -> location, dry_bulb_temperature, dew_point_temperature, relative_humidity, wind_speed, wind_direction, direct_normal_rad, diffuse_horizontal_rad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; plug-in component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
number_slider = Slider(3, range=0..10)
number_slider_2 = Slider(11, range=0..100)
addition = Addition(A=number_slider_2, B=1)
addition_2 = Addition(A=number_slider, B=1)

# ---- group: NO leaves time
analysisperiod = LBAnalysisPeriod(start_month=addition, start_day=1, start_hour=0, end_month=number_slider)  # -> period, hoys, dates; plug-in component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
skymatrix = LBCumulativeSkyMatrix(
    location=importepw.location,
    direct_rad=importepw.direct_normal_rad,
    diffuse_rad=importepw.diffuse_horizontal_rad,
    hoys=analysisperiod.hoys)  # -> report, sky_mtx; plug-in component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

# ---- group: leaves time
analysisperiod_2 = LBAnalysisPeriod(start_month=addition_2, start_day=1, start_hour=0, end_month=number_slider_2)  # -> period, hoys, dates; plug-in component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
skymatrix_2 = LBCumulativeSkyMatrix(
    location=importepw.location,
    direct_rad=importepw.direct_normal_rad,
    diffuse_rad=importepw.diffuse_horizontal_rad,
    hoys=analysisperiod_2.hoys)  # -> report, sky_mtx; plug-in component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

# ----
panel_3 = Panel("""15, 7, 135
79, 2, 162
202, 70, 120
244, 137, 71
239, 248, 33""")
col = Colour(panel_3)
legendpar = LBLegendParameters(colors=col, font="Times New Roman")  # -> leg_par; plug-in component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
number_slider_3 = Slider(0.01, range=0..0.01)
number_slider_4 = Slider(1, range=0..1)
number_slider_5 = Slider(0.01, range=0..0.01)
number_slider_6 = Slider(1, range=0..1)

# ----
# Solar panel
# Capacity
panel_4 = Panel("0.4")

number_slider_7 = Slider(1, range=0..10)
footprints_2 = Curve(footprints)
panel_5 = Panel("1")
panel_6 = Panel("D:\GATECH\HPBL\GitHub\Solar API\location_data_GH.csv")
footprints_3 = Curve(footprints)
boundary = BoundarySurfaces(Edges=footprints_3)
area = Area(Geometry=boundary)  # -> Area, Centroid
nullrep = ReplaceNulls(Items=area.Area, Replacements="0")  # -> Items, Count
panel_7 = Panel(nullrep.Items)
geo_locations_2 = Number(geo_locations)
item_4 = ListItem(List=geo_locations_2, Index=0, Wrap=True)  # -> simplify(Item), simplify(Item1)
merge = Merge(
    Data1="maxArrayPanelsCount",
    Data2="maxArrayAreaMeters2",
    Data3="numSegments",
    Data4="maxSunshineHoursPerYear",
    Data5="totSunshineHoursPerYear",
    Data6="areaMeters2",
    Data7="groundAreaMeters2",
    Data8="maxYearlyEnergyDcKwh",
    Data9="numTreePointsInFootprint",
    Data10="footprinAreaMeters2",
    Data11="longitude",
    Data12="latitude")
merge_2 = Merge(
    Data1="fitted slope deviation [m]",
    Data2="reconstructed area ratio",
    Data3="reconstruction shrinkage [m]",
    Data4="vegetation overlap [num. pt/m²]",
    Data5="max total DC energy [kWh/year]",
    Data6="max PV panel count",
    Data7="max PV panel area",
    Data8="number of roof slopes",
    Data9="max cir",
    Data10="cumulative IR [kWh/year]",
    Data11="reconstructed roof area [m]",
    Data12="g area")
flip = FlipMatrix(Data=geo_locations_2)
merge_3 = Merge(Data1="x", Data2="y")
csv = CreateCSV(DataGridHeaders=merge_3, ValueTree=flip, Delimiter=",")
panel_8 = Panel(csv)

# ----
# Solar API
# Panel Width
panel_9 = Panel("1.879")

# ----
# Solar API
# Panel Height
panel_10 = Panel("1.045")

# ----
# Split LiDAR data
xmin_4 = Number(xmin)
pointcloud_crs_2 = Integer(pointcloud_crs)
temp_path_3 = Text(temp_path)
xmin_5 = Number(buildings_osm.xmin_new)
ymin_4 = Number(buildings_osm.ymin_new)
xmax_4 = Number(buildings_osm.xmax_new)
ymax_4 = Number(buildings_osm.ymax_new)
out_crs_4 = Integer(out_crs)
tstat_3 = TreeStatistics(Tree=xmin_4)  # -> Paths, Length, Count
lidar = Python3Script(
    xmin=xmin_5,
    ymin=ymin_4,
    xmax=xmax_4,
    ymax=ymax_4,
    temp_path=temp_path_3,
    out_crs=out_crs_4,
    pointcloud_crs=pointcloud_crs_2)  # -> scan; inputs temp_path: String
# ---------- lidar: Python ----------
import requests
import laspy
import os
import numpy as np
from pyproj import Transformer
from urllib.request import urlretrieve
import json

def request_data_by_bbox(xmin, ymin, xmax, ymax):
    params = {
            'datasets':  'Lidar Point Cloud (LPC)',
            'bbox': f'{xmin}, {ymin}, {xmax}, {ymax}',
            'outputFormat': 'JSON'
    }

    r = requests.get('https://tnmaccess.nationalmap.gov/api/v1/products?', params)

    r_json =  r.json()

    newest = max([item['publicationDate'] for item in r_json['items']])

    return [item['downloadLazURL'] for item in r_json['items'] if item['publicationDate'] == newest]


file_name = temp_path + \
    f'pc_crs EPSG {pointcloud_crs}, out_crs EPSG {out_crs}, bbox {xmin}, {ymin}, {xmax}, {ymax} ' + 'LiDAR_merged.las'

if os.path.isfile(file_name):
    scan = laspy.read(file_name)

else:
    try:
        if temp_path:
            lidar_urls = request_data_by_bbox(xmin, ymin, xmax, ymax)
        else:
            lidar_urls = []  
    except:
        lidar_urls = []                

    # Save data locally
    for url in lidar_urls:
        if os.path.isfile(temp_path + url.rpartition('/')[-1]):
            continue
        else:
            urlretrieve(url, temp_path + url.rpartition('/')[-1])

    all_scan_points_arrays = []
    all_scan_xyzs = []

    transformer = Transformer.from_crs("EPSG:4326",  f"EPSG:{out_crs}", always_xy=True)
    xmin_t, ymin_t = transformer.transform(xmin, ymin)
    xmax_t, ymax_t = transformer.transform(xmax, ymax)

    # Read all the scans
    for url in lidar_urls:
        scan = laspy.read(temp_path + url.rpartition('/')[-1])

        transformed_coords = (scan.xyz[:,0], scan.xyz[:,1], scan.xyz[:,2])
        
        if pointcloud_crs != out_crs:
            # The EPGS code for NAD83(2011) / Conus Albers is 6350
            # The EPGS code for WGS84 is 4326
            transformer2 = Transformer.from_crs(f"EPSG:{pointcloud_crs}", f"EPSG:{out_crs}", always_xy=False)
            transformed_coords = transformer2.transform(scan.xyz[:,0], scan.xyz[:,1], scan.xyz[:,2])

        # We now need to filter by world coordinates bounding box so we get 
        # the points only for our area of interest. Lets inspect in what 
        # coordinate system are the scans.

        mask = ((transformed_coords[0] > xmin_t) & (transformed_coords[0] < xmax_t) &
                            (transformed_coords[1] > ymin_t) & (transformed_coords[1] < ymax_t))

        filtered_scan = scan[mask]

        # transformer = Transformer.from_crs("EPSG:6350", f"EPSG:{out_crs}")

        # lidar_sample = transformer.transform(filtered_scan.points.x, 
        #                                      filtered_scan.points.y, 
        #                                      filtered_scan.points.z)
                                    
        filtered_scan.xyz[:,0] = transformed_coords[0][mask]
        filtered_scan.xyz[:,1] = transformed_coords[1][mask]
        filtered_scan.xyz[:,2] = transformed_coords[2][mask]

        all_scan_xyzs.append(np.stack([transformed_coords[0][mask], 
                                    transformed_coords[1][mask], 
                                    transformed_coords[2][mask]], axis=1))

        # filtered_scan.points.x = transformed_coords[0][mask]
        # filtered_scan.points.y = transformed_coords[1][mask]
        # filtered_scan.points.z = transformed_coords[2][mask]
        all_scan_points_arrays.append(filtered_scan.points.array)
        

    # Merge into one dataset
    all_scan_points = np.concatenate(all_scan_points_arrays)
    all_scan_xyz = np.concatenate(all_scan_xyzs)

    scan = laspy.create(point_format=scan.header.point_format, file_version=scan.header.version)
    scan.points.array = all_scan_points
    scan.xyz = all_scan_xyz
    scan.write(file_name)
# ---------- end lidar ----------
dpath_2 = DeconstructPath(Branch=tstat_3.Paths)
translation_3 = Vector(translation)
item_5 = ListItem(List=dpath_2, Index=0, Wrap=True)
out_crs_5 = Integer(out_crs)
out_crs_6 = Integer(out_crs)
out_crs_7 = Integer(out_crs)

# ---- group: Extract and Cluster Trees
trees = Script(
    scan=lidar,
    min_cluster_size=Slider(100, range=0..1000),
    out_crs=out_crs_5,
    tree_level=item_5,
    translation=translation_3,
    sampling_density=Slider(1, range=0..1))  # -> mean_dists, all_leftover_points, a; inputs min_cluster_size: Int32, tree_level: Int32, translation: Vector3d, sampling_density: Double
# ---------- trees: Python ----------
import numpy as np
import geopandas as gpd
import rasterio as rio
import numpy as np
import laspy
import rhinoscriptsyntax as rs
import numpy as np
from sklearn import metrics
from sklearn.cluster import DBSCAN
import ghpythonlib.treehelpers as th
import Rhino
from scipy import spatial

vegetation_types = [
    #3,# Low Vegetation
    #4,# Medium Vegetation
    5 # High Vegetation
]

mean_dists = []
all_vegetation_clusters = []
all_leftover_points = []

for i in vegetation_types:

    trees = laspy.create(point_format=scan.header.point_format, file_version=scan.header.version)
    trees.points = scan.points[scan.classification == i]

    trees_pts = np.stack([trees.xyz[:,0] + translation.X,  
                          trees.xyz[:,1] + translation.Y, 
                          trees.xyz[:,2] + translation.Z], axis=1)

                        
    trees_scan_pts_gpd = gpd.points_from_xy(trees_pts[:,0], trees_pts[:,1])


    d = {'geometry': trees_scan_pts_gpd}

    trees_scan_pts_gpd = gpd.GeoDataFrame(d, crs=f"EPSG:{out_crs}")

    trees_scan_pts_gpd['z'] = trees_pts[:,2]


    X = np.stack([trees_scan_pts_gpd.geometry.x, 
                trees_scan_pts_gpd.geometry.y, 
                trees_scan_pts_gpd['z']], axis=1)

    # width =  np.max(trees_scan_pts_gpd.geometry.x) - np.min(trees_scan_pts_gpd.geometry.x)
    # height = np.max(trees_scan_pts_gpd.geometry.y) - np.min(trees_scan_pts_gpd.geometry.y)

    # bbox_area = width * height

    # density =  trees_scan_pts_gpd.shape[0] / bbox_area
    # spacing = 1.5 / np.sqrt(density)

            # find average spacing between points
    tree = spatial.KDTree(X)
    distance, index = tree.query(X, k=3)
    mean_dist = np.mean(distance[:,1:])
    mean_dists.append(mean_dist)
    if mean_dist < 0.01: 
        continue                
    print(f"Mean distance: {mean_dist}")
    # eps - The maximum distance between two samples for one to be 
    # considered as in the neighborhood of the other.
    # min_samples affects the minimum size of each cluster formed
    db = DBSCAN(eps=mean_dist*2, min_samples=10).fit(X)
    labels = db.labels_

    # Number of clusters in labels, ignoring noise if present.
    n_clusters_ = len(set(labels)) - (1 if -1 in labels else 0)
    n_noise_ = list(labels).count(-1)

    print("Estimated number of clusters: %d" % n_clusters_)
    print("Estimated number of noise points: %d" % n_noise_)


    vegetation_clusters = []
    leftover_points = []
    unique_labels = set(labels)

    for k in unique_labels:
        class_member_mask = labels == k
        cluster_points = trees_scan_pts_gpd.iloc[class_member_mask]

        cluster = rs.AddPoints(
                np.stack([cluster_points.geometry.x,
                          cluster_points.geometry.y,
                          cluster_points.z], axis=1))

        if k == -1 or cluster_points.shape[0] < min_cluster_size:
            leftover_points.append(cluster)

        else:
            vegetation_clusters.append(cluster)



        
    all_leftover_points.append(leftover_points)
    all_vegetation_clusters.append(vegetation_clusters)

a = th.list_to_tree(all_vegetation_clusters, source=[tree_level])
all_leftover_points = th.list_to_tree(all_leftover_points, source=[tree_level])
# ---------- end trees ----------

# ---- group: scan to GeoDataFrame
project = Script(scan=lidar, out_crs=out_crs_6)  # -> buildings_scan_pts_gpd, density, spacing
# ---------- project: Python ----------
import numpy as np
import geopandas as gpd
import rasterio as rio
import numpy as np
import laspy

buildings = laspy.create(
    point_format=scan.header.point_format, 
    file_version=scan.header.version)

points_to_calc = scan.points[#(scan.number_of_returns == 1) & 
                             (scan.return_number == 1)]

width =  np.max(points_to_calc.x) - np.min(points_to_calc.x)
height = np.max(points_to_calc.y) - np.min(points_to_calc.y)

rt = scan.number_of_returns
rt2 = scan.return_number
over = scan.overlap
bbox_area = width * height

density =  points_to_calc.array.shape[0] / bbox_area
spacing = 1.5 / np.sqrt(density)

buildings.points = scan.points[(scan.classification == 6)]# &
                               #(scan.number_of_returns == 1) & 
                               #(scan.return_number == 1)]

buildings_pts = np.stack([buildings.points.x, 
                          buildings.points.y, 
                          buildings.points.z], axis=1)


buildings_scan_pts_gpd = gpd.points_from_xy(buildings_pts[:,0], buildings_pts[:,1])


d = {'geometry': buildings_scan_pts_gpd}
buildings_scan_pts_gpd = gpd.GeoDataFrame(d, crs=f"EPSG:{out_crs}")

buildings_scan_pts_gpd['z'] = buildings_pts[:,2]


print(buildings_scan_pts_gpd.head())
# ---------- end project ----------

# ---- group: Get tree points gpd
project_2 = Script(scan=lidar, out_crs=out_crs_7)  # -> tree_scan_pts_gpd, density, spacing
# ---------- project_2: Python ----------
import numpy as np
import geopandas as gpd
import rasterio as rio
import numpy as np
import laspy

buildings = laspy.create(
    point_format=scan.header.point_format, 
    file_version=scan.header.version)

points_to_calc = scan.points

print(scan.points.x.shape[0])

print(points_to_calc.x.shape[0])

width =  np.max(points_to_calc.x) - np.min(points_to_calc.x)
height = np.max(points_to_calc.y) - np.min(points_to_calc.y)

rt = scan.number_of_returns
rt2 = scan.return_number
over = scan.overlap
bbox_area = width * height

density = points_to_calc.x.shape[0] / bbox_area
spacing = 1 / np.sqrt(density)

buildings.points = scan.points[(scan.classification == 3) |
                               (scan.classification == 4) | 
                               (scan.classification == 5)]

buildings_pts = np.stack([buildings.points.x, 
                          buildings.points.y, 
                          buildings.points.z], axis=1)


tree_scan_pts_gpd = gpd.points_from_xy(buildings_pts[:,0], buildings_pts[:,1])


d = {'geometry': tree_scan_pts_gpd}
tree_scan_pts_gpd = gpd.GeoDataFrame(d, crs=f"EPSG:{out_crs}")

tree_scan_pts_gpd['z'] = buildings_pts[:,2]


print(tree_scan_pts_gpd.head())
# ---------- end project_2 ----------

# ----
density = Number(project.density)
spacing = Number(project.spacing)
tree_points = Point(trees.a)
pt_3 = Point(trees.all_leftover_points)

intersect = Python3Script(tree_scan_pts_gpd=project_2.tree_scan_pts_gpd, buildings=buildings_osm.buildings)  # -> mapped_points_df, remaining_points_df
# ---------- intersect: Python ----------
import numpy as np
import scipy.spatial as spatial
import geopandas as gpd
import pandas as pd

points = np.stack([tree_scan_pts_gpd.geometry.x, tree_scan_pts_gpd.geometry.y], axis=1)

# point_tree = spatial.cKDTree(points)

mapped_points = {}

global_inersect = None

for i in range(buildings.shape[0]):
    #if i != 8: continue
    footprint = buildings.iloc[i].geometry
    
    #surrounding_points = point_tree.query_ball_point([footprint.centroid.x, footprint.centroid.y], footprint.area / 2)
    
    does_intersect = tree_scan_pts_gpd.geometry.intersects(footprint)
    mapped_points[i] = tree_scan_pts_gpd[does_intersect]

    if global_inersect is None:
        global_inersect = does_intersect
    else:
        global_inersect = np.logical_or(global_inersect, does_intersect)


mapped_points_df = gpd.GeoDataFrame(pd.concat(mapped_points.values(), keys=mapped_points.keys(), axis=0))
remaining_points_df = tree_scan_pts_gpd[global_inersect == False]

print(mapped_points_df.shape)
print(tree_scan_pts_gpd[global_inersect == True].shape)
# ---------- end intersect ----------

# ----
# OPTIONAL: Use DEM data to project Roofs and trees to DEM surface
temp_path_4 = Text(temp_path)
ymin_5 = Number(ymin)
out_crs_8 = Integer(out_crs)
xmin_6 = Number(xmin)
xmax_5 = Number(xmax)
ymax_5 = Number(ymax)
dem = Script(xmin=xmin_6, ymin=ymin_5, xmax=xmax_5, ymax=ymax_5, temp_path=temp_path_4, out_crs=out_crs_8)  # -> dem_path, heights, x_tr, y_tr, xnumber, ynumber; inputs xmin: Double, ymin: Double, xmax: Double, ymax: Double; disabled
# ---------- dem: Python ----------
import rasterio
import requests
import numpy as np
from pyproj import Transformer
from rasterio.windows import from_bounds
from rasterio.merge import merge
import ghpythonlib.treehelpers as th
import os
from rasterio.warp import calculate_default_transform, reproject, Resampling

def request_data_by_bbox(xmin, ymin, xmax, ymax):
    params = {
            'datasets':  'Digital Elevation Model (DEM) 1 meter',
            'bbox': f'{xmin}, {ymin}, {xmax}, {ymax}'
    }

    r = requests.get('https://tnmaccess.nationalmap.gov/api/v1/products?', params)
    try:
        return [item['downloadURL'] for item in r.json()['items']]
    except:
        return []

def merge_maps(maps_to_merge_urls, xmin_t, ymin_t, xmax_t, ymax_t):
    elevation_arrays = [] 
    maps_to_merge = []
    src_bands = []
    for url in maps_to_merge_urls:
        with rasterio.open(url) as src:
            bbox = from_bounds(xmin_t, ymin_t, xmax_t, ymax_t, src.transform)
            elevation_array = src.read(1, window=bbox)
            print(elevation_array.shape)
            if elevation_array.shape[0] == 0:
                continue
            if elevation_array.shape[1] == 0:
                continue
            elevation_arrays.append(elevation_array)
            meta_data = src.profile.data

            new_transform = rasterio.Affine(src.transform.a, 
                                        src.transform.b, 
                                        max(src.bounds.left, xmin_t), # translation in x
                                        src.transform.d, 
                                        src.transform.e, 
                                        min(src.bounds.top, ymax_t)) # translation in y
            print(elevation_array.shape)

            cropped_map = rasterio.open(temp_path + url.rpartition('/')[-1], 'w', driver='GTiff',
                                        height=elevation_array.shape[0], width=elevation_array.shape[1],
                                        count=1, dtype=str(elevation_array.dtype),
                                        crs=src.crs,
                                        transform=new_transform)


            cropped_map.write(elevation_array, 1)
            cropped_map.close()

            cropped_map_read = rasterio.open(temp_path + url.rpartition('/')[-1])
            maps_to_merge.append(cropped_map_read)
    if len(maps_to_merge) == 0:
        return
    mosaic, output = merge(maps_to_merge)

    output_meta = cropped_map.meta.copy()
    output_meta.update(
        {   
            "driver": "GTiff",
            "height": mosaic.shape[1],
            "width": mosaic.shape[2],
            "transform": output,
            "crs": maps_crs
        })

    for map_to_merge in maps_to_merge:
        map_to_merge.close()

    with rasterio.open(file_name, "w", **output_meta) as m:
        m.write(mosaic)
    
    with rasterio.open(file_name) as src:
        transform, width, height = calculate_default_transform(
            src.crs, f"EPSG:{out_crs}", src.width, src.height, *src.bounds)
        kwargs = src.meta.copy()
        kwargs.update({
            'crs': f"EPSG:{out_crs}",
            'transform': transform,
            'width': width,
            'height': height
        })

        with rasterio.open(temp_path + f'{xmin}, {ymin}, {xmax}, {ymax} ' + 'DEM_merged_.tif', 'w', **kwargs) as dst:
            for i in range(1, src.count + 1):
                reproject(
                    source=rasterio.band(src, i),
                    destination=rasterio.band(dst, i),
                    src_transform=src.transform,
                    src_crs=src.crs,
                    dst_transform=transform,
                    dst_crs=f"EPSG:{out_crs}",
                    resampling=Resampling.nearest)


file_name = temp_path + f'{xmin}, {ymin}, {xmax}, {ymax} ' + 'DEM_merged.tif'

if os.path.isfile(file_name):
    dem_path = temp_path + f'{xmin}, {ymin}, {xmax}, {ymax} ' + 'DEM_merged_.tif'
elif temp_path:

    map_urls = request_data_by_bbox(xmin, ymin, xmax, ymax)
    if len(map_urls) > 0:
        with rasterio.open(map_urls[0]) as src:
            maps_crs = src.crs

        transformer = Transformer.from_crs("EPSG:4326", maps_crs)

        points =np.array([[xmin, ymin],
                  [xmax, ymin],
                  [xmax, ymax],
                  [xmin, ymax],
                  [xmin, ymin]])

        points0_t, points1_t = transformer.transform(points[:,1], points[:,0])

        xmin_t, ymin_t, xmax_t, ymax_t = points0_t[0] - 100, points1_t[0] - 100, points0_t[2] + 100, points1_t[2] + 100# transformed_coords[0][0], transformed_coords[1][0], transformed_coords[0][1], transformed_coords[1][1]

        merge_maps(map_urls, xmin_t, ymin_t, xmax_t, ymax_t)

        dem_path = temp_path + f'{xmin}, {ymin}, {xmax}, {ymax} ' + 'DEM_merged_.tif'

# y_tr = meta_data['transform'][2]
# x_tr = meta_data['transform'][5]

# xnumber  = result.shape[0]
# ynumber  = result.shape[1]

# heights = th.list_to_tree(result.tolist())
# ---------- end dem ----------
number_slider_8 = Slider(170, range=0..500)
xmin_7 = Number(xmin)
out_crs_9 = Integer(out_crs)
ymin_6 = Number(ymin)
xmax_6 = Number(xmax)
ymax_6 = Number(ymax)
py3 = Python3Script(
    dem_path=dem.dem_path,
    xmin=xmin_7,
    ymin=ymin_6,
    xmax=xmax_6,
    ymax=ymax_6,
    x_count=Slider(200, range=0..500),
    y_count=number_slider_8,
    out_crs=out_crs_9)  # -> out, x_coords, y_coords, z_coords; inputs dem_path: String, xmin: Double, ymin: Double, xmax: Double, ymax: Double, x_count: Int32, y_count: Int32, out_crs: String
# ---------- py3: Python ----------
import numpy as np
import geopandas as gpd
import rasterio as rio
import numpy as np
import laspy
import rhinoscriptsyntax as rs
import numpy as np
from sklearn import metrics
from sklearn.cluster import DBSCAN
import ghpythonlib.treehelpers as th
import shapely
from pyproj import Transformer
import System

# open the dem
with rio.open(dem_path) as src:
    elev = src.read(1)
    transformer = Transformer.from_crs(crs_from="EPSG:4326", crs_to=src.crs)

    x_ = np.linspace(xmin, xmax, x_count )
    y_ = np.linspace(ymin, ymax, y_count )
    x_grid, y_grid = np.meshgrid(x_, y_)

    x_grid_t, y_grid_t = transformer.transform(y_grid.ravel(), x_grid.ravel())

    rows, cols = rio.transform.rowcol(src.transform, x_grid_t, y_grid_t)

rows = np.array(rows)
cols = np.array(cols)
rows[rows > elev.shape[0] - 1] = elev.shape[0] - 1
cols[cols > elev.shape[1] - 1] = elev.shape[1] - 1

print(type(elev[rows - 1, cols - 1][0]))

z_coords = list(np.float64(elev[rows, cols]))
x_coords = list(np.float64(x_grid_t))
y_coords = list(np.float64(y_grid_t))
# ---------- end py3 ----------
footprints_4 = Curve(footprints)
pt_4 = ConstructPoint(XCoordinate=py3.x_coords, YCoordinate=py3.y_coords, ZCoordinate=py3.z_coords)
translation_4 = Vector(translation)
move_3 = Move(Geometry=pt_4, Motion=translation_4)  # -> Geometry, Transform
trim = TrimTree(Tree=footprints_4, Depth=1)
srfgrid = SurfaceFromPoints(Points=move_3.Geometry, UCount=number_slider_8, Interpolate=False)
project_3 = Project(Curve=footprints_4, Brep=srfgrid, Direction=Vector(0, 0, 1))
match = MatchTree(Tree=project_3, Guide=graft(footprints_4))
boundary_2 = BoundarySurfaces(Edges=footprints_4)
trim_2 = TrimTree(Tree=match, Depth=1)
explode = Explode(Curve=trim_2, Recursive=True)  # -> Segments, Vertices
trim_3 = TrimTree(Tree=explode.Vertices, Depth=1)
avr = Average(Input=trim_3)
pdecon = Deconstruct(Point=avr)  # -> XComponent, YComponent, ZComponent
item_6 = ListItem(List=pdecon.ZComponent, Index=0, Wrap=True)
Z = UnitZ(Factor=pdecon.ZComponent)
translation_5 = Vector(translation)
move_4 = Move(Geometry=boundary_2, Motion=Z)  # -> Geometry, Transform
bbox_4 = Curve(bbox_2)
Z_2 = UnitZ(Factor=pdecon.ZComponent)
neg = Negative(Value=Z_2)

# ---- group: DEM
srf = Surface(srfgrid)

# ----
# Building Data
intersect_2 = Python3Script(buildings_scan_pts_gpd=project.buildings_scan_pts_gpd, buildings=buildings_osm.buildings)  # -> mapped_points_df, remaining_points_df
# ---------- intersect_2: Python ----------
import numpy as np
import scipy.spatial as spatial
import geopandas as gpd
import pandas as pd

points = np.stack([buildings_scan_pts_gpd.geometry.x, buildings_scan_pts_gpd.geometry.y], axis=1)

# point_tree = spatial.cKDTree(points)

mapped_points = {}

global_inersect = None

for i in range(buildings.shape[0]):
    #if i != 8: continue
    footprint = buildings.iloc[i].geometry
    
    #surrounding_points = point_tree.query_ball_point([footprint.centroid.x, footprint.centroid.y], footprint.area / 2)
    
    does_intersect = buildings_scan_pts_gpd.geometry.intersects(footprint)
    mapped_points[i] = buildings_scan_pts_gpd[does_intersect]

    if global_inersect is None:
        global_inersect = does_intersect
    else:
        global_inersect = np.logical_or(global_inersect, does_intersect)


mapped_points_df = gpd.GeoDataFrame(pd.concat(mapped_points.values(), keys=mapped_points.keys(), axis=0))
remaining_points_df = buildings_scan_pts_gpd[global_inersect == False]

print(mapped_points_df.shape)
print(buildings_scan_pts_gpd[global_inersect == True].shape)
# ---------- end intersect_2 ----------
py3_2 = Python3Script(mapped_points_df=intersect_2.mapped_points_df, buildings=buildings_osm.buildings)  # -> buildings_points, buildings_heights
# ---------- py3_2: Python ----------
import numpy as np
import geopandas as gpd
import pandas as pd
import rhinoscriptsyntax as rs
import ghpythonlib.treehelpers as th

buildings_points = []
buildings_heights = []

indices = set(mapped_points_df.index.codes[0])

for i in range(buildings.shape[0]):
    if i not in indices:
        buildings_points.append([])
        buildings_heights.append(0)
    else:
        points = rs.AddPoints(np.stack([
            mapped_points_df.loc[i].geometry.x,
            mapped_points_df.loc[i].geometry.y,
            mapped_points_df.loc[i].z], axis=1))
        buildings_points.append(points)
        if "HEIGHT" in buildings.columns.tolist():
            buildings_heights.append(buildings.loc[i].HEIGHT)


buildings_points = th.list_to_tree(buildings_points)
# ---------- end py3_2 ----------
py3_3 = Python3Script(mapped_points_df=intersect.mapped_points_df, buildings=buildings_osm.buildings)  # -> buildings_points, buildings_heights; same code as py3_2
translation_6 = Vector(translation)
translation_7 = Vector(translation)
translation_8 = Vector(translation)
move_5 = Move(Geometry=py3_2.buildings_points, Motion=translation_6)  # -> Geometry, Transform
move_6 = Move(Geometry=py3_3.buildings_points, Motion=translation_8)  # -> Geometry, Transform
branch_2 = TreeBranch(Tree=simplify(move_6.Geometry), Path=tstat_2.Paths, MaintainPaths=False)
branch_3 = TreeBranch(Tree=simplify(move_5.Geometry), Path=tstat_2.Paths, MaintainPaths=False)
path_mapper = PathMapper(branch_3, source="{A}", target="{0;A}")
tree_points_inside_footprints = Point(branch_2)
building_points_inside_footprints = Point(path_mapper)

# ---- group: Remaining Points
py3_4 = Python3Script(remainning_points_df=intersect_2.remaining_points_df)  # -> a
# ---------- py3_4: Python ----------
import numpy as np
import geopandas as gpd
import pandas as pd
import rhinoscriptsyntax as rs
import ghpythonlib.treehelpers as th


a = rs.AddPoints(np.stack([remainning_points_df.geometry.x,
                remainning_points_df.geometry.y,
                remainning_points_df.z], axis=1))
# ---------- end py3_4 ----------

# ----
move_7 = Move(Geometry=py3_4, Motion=translation_7)  # -> Geometry, Transform
building_points_outside_footprints = Point(move_7.Geometry)

building_points_inside_footprints_2 = Point(building_points_inside_footprints)
building_points = Point(building_points_inside_footprints_2)

# ----
# Tree points inside footprint
# [num. points / m2]
tree_points_inside_footprints_2 = Point(tree_points_inside_footprints)
area_2 = Area(Geometry=footprints_2)  # -> Area, Centroid
lng = ListLength(List=tree_points_inside_footprints_2)
ma = MassAddition(Input=flatten(area_2.Area))  # -> Result, PartialResults
ma_2 = MassAddition(Input=flatten(lng))  # -> Result, PartialResults
division = Division(A=lng, B=area_2.Area)
avr_2 = Average(Input=division)
panel_11 = Panel(avr_2)

numtreepointsinfootprint = Number(avr_2)
nullrep_2 = ReplaceNulls(Items=numtreepointsinfootprint, Replacements="0")  # -> Items, Count
panel_12 = Panel(nullrep_2.Items)

move_8 = Move(Geometry=py3_2.buildings_points, Motion=translation_5)  # -> Geometry, Transform
avr_3 = Average(Input=move_8.Geometry)
pdecon_2 = Deconstruct(Point=avr_3)  # -> XComponent, YComponent, ZComponent
subtraction = Subtraction(A=pdecon_2.ZComponent, B=item_6)
null = NullItem(Item=pdecon_2.ZComponent)  # -> NullFlags, InvalidFlags, Description
cull_2 = CullPattern(List=subtraction, CullPattern=invert(null.NullFlags))
merge_4 = Merge(Data1=cull_2)
null_2 = NullItem(Item=merge_4)  # -> NullFlags, InvalidFlags, Description
Z_3 = UnitZ(Factor=subtraction)
ma_3 = MassAddition(Input=flatten(null_2.InvalidFlags))  # -> Result, PartialResults
cull_3 = CullPattern(List=footprints_4, CullPattern=invert(null_2.InvalidFlags))
cull_4 = CullPattern(List=merge_4, CullPattern=invert(null_2.InvalidFlags))
cull_5 = CullPattern(List=move_4.Geometry, CullPattern=invert(null_2.InvalidFlags))
area_3 = Area(Geometry=cull_5)  # -> Area, Centroid
trim_4 = TrimTree(Tree=cull_4, Depth=1)
colom_2 = CollisionOneMany(Collider=bbox_4, Obstacles=cull_3)  # -> Collision, Index
trim_5 = TrimTree(Tree=area_3.Area, Depth=1)

# ---- group: Building Solids
extr = Extrude(Base=boundary_2, Direction=Z_3)

# ---- group: Average Height
avr_4 = Average(Input=trim_4)

# ---- group: Average Area
avr_5 = Average(Input=trim_5)

# ---- group: Building Height to Area Ratio
division_2 = Division(A=avr_4, B=avr_5)

# ----
cull_6 = CullPattern(List=extr, CullPattern=invert(null_2.InvalidFlags))
cull_7 = CullPattern(List=cull_6, CullPattern=invert(colom_2.Collision))
clean_2 = CleanTree(RemoveNulls=True, RemoveInvalid=True, RemoveEmpty=invert(False), Tree=cull_7)  # -> simplify(Tree)
tstat_4 = TreeStatistics(Tree=clean_2)  # -> Paths, Length, Count
branch_4 = TreeBranch(Tree=clean_2, Path=tstat_4.Paths, MaintainPaths=False)
buildings = Mesh(branch_4)

# ----
# Reconstructing Vegetation
number_slider_9 = Slider(1, range=0..10)
tree_points_2 = Point(simplify(tree_points))
Z_4 = UnitZ(Factor=1)
toggle = BooleanToggle(True)

# ---- group: Alpha Wrap Roofs
# 3D Alpha Wrapping
py3_5 = Python3Script(points_tree=tree_points_2, density=number_slider_9, spacing=Slider(0.5, range=0..10))  # -> mean_dists, b; inputs points_tree: list of Point3d, density: Double, spacing: Double
# ---------- py3_5: Python ----------
import Rhino
import ghpythonlib.treehelpers as th
from CGAL import CGAL_Alpha_wrap_3
from CGAL.CGAL_Alpha_wrap_3 import Point_3_Vector
from CGAL.CGAL_Alpha_wrap_3 import Polygon_Vector
from CGAL.CGAL_Alpha_wrap_3 import Int_Vector
from CGAL.CGAL_Polyhedron_3 import Polyhedron_3
from CGAL import CGAL_Polygon_mesh_processing
from CGAL.CGAL_Kernel import Point_3
from CGAL.CGAL_Point_set_3 import Point_set_3
from CGAL.CGAL_Shape_detection import *
from CGAL.CGAL_Point_set_processing_3 import *
from CGAL.CGAL_Advancing_front_surface_reconstruction import *
from scipy import spatial
import rhinoscriptsyntax as rs
import geopandas as gpd
import numpy as np

import System
mean_dists = []
a = []
b = []

if points_tree is not None and len(points_tree) > 4:
    points_set = Point_set_3()

    x_coords = []
    y_coords = []
    z_coords = []
    for point_ in points_tree:
        idx = points_set.insert(Point_3(point_.X, point_.Y, point_.Z))
        x_coords.append(point_.X)
        y_coords.append(point_.Y)
        z_coords.append(point_.Z)
        
    X = np.stack([x_coords, 
                y_coords, 
                z_coords], axis=1)

    # find average spacing between points
    tree = spatial.KDTree(X)
    distance, index = tree.query(X, k=3)
    mean_dist = np.mean(distance[:,1:])
    mean_dists.append(mean_dist)

    if mean_dist > 0.01: 
        Q = Polyhedron_3()
        #advancing_front_surface_reconstruction(points_set, Q)
        # # # test with a point set as input
        CGAL_Alpha_wrap_3.alpha_wrap_3(list(points_set.points()), density*1.2, spacing, Q)
        mesh_points = {} 
        counter = 0
        for mesh_point in Q.points():
            mesh_points[(mesh_point.x(), mesh_point.y(), mesh_point.z())] = counter
            counter +=1
        mesh_faces = []
        for mesh_face in Q.facets():
            current_face = mesh_face.halfedge()
            p1 = (current_face.vertex().point().x(), 
                current_face.vertex().point().y(), 
                    current_face.vertex().point().z())
            idx1 = mesh_points[p1]
            current_idx = -1
            ids = []
            ids.append(System.Int32(idx1))
            stopcounter = 0
            while stopcounter < 10:
                current_face = current_face.next()
                stopcounter += 1
                p2 = (current_face.vertex().point().x(), 
                    current_face.vertex().point().y(), 
                    current_face.vertex().point().z())
                current_idx = System.Int32(mesh_points[p2])
                if current_idx in ids:
                    break
                ids.append(System.Int32(current_idx))
            last = ids[-1]
            ids.append(last)
            mesh_faces.append(tuple(ids))
        test_cells = list(map(tuple, mesh_faces))
        test_points = list(map(tuple, mesh_points.keys()))
        b.append(rs.AddMesh(test_points, test_cells))
        

# a = th.list_to_tree(a)
# ---------- end py3_5 ----------

# ----
disjoint = DisjointMesh(Mesh=py3_5.b)
volume = MeshVolume(Mesh=disjoint)  # -> Volume, Centroid
smaller = SmallerThan(FirstNumber=volume.Volume, SecondNumber=Slider(7, range=0..10))  # -> SmallerThan, OrEqualTo
cull_8 = CullPattern(List=disjoint, CullPattern=invert(smaller.SmallerThan))
convquads = MeshConvertQuads(Mesh=cull_8, ShortDiagonal=True)  # -> Mesh, Split
rebmsh = RebuildMesh(
    Mesh=flatten(convquads.Mesh),
    RebuildNormals=Toggle(True),
    CullUnused=False,
    UnifyNormals=Toggle(True),
    FlipNormals=False,
    IdenticalCombine=False,
    WeldVertices=0)
mesh = Mesh(graft(rebmsh))
facen = FaceNormals(Mesh=mesh)  # -> Centers, Normals
explode_2 = MeshExplode(Mesh=mesh, Interpolate=False)
dprod = DotProduct(VectorA=facen.Normals, VectorB=Z_4, Unitize=False)
larger = LargerThan(FirstNumber=dprod, SecondNumber=0)  # -> LargerThan, OrEqualTo
cull_9 = CullPattern(List=explode_2, CullPattern=larger.LargerThan)
lng_2 = ListLength(List=cull_9)
multiplication = Multiplication(A=lng_2, B=Slider(0.5, range=0..1))
random = Random(Range=lng_2, Number=multiplication, Seed=2)
int = Integer(random)
item_7 = ListItem(List=cull_9, Index=int, Wrap=True)
mjoin = MeshJoin(Meshes=item_7)
rebmsh_2 = RebuildMesh(
    Mesh=mjoin,
    RebuildNormals=Toggle(True),
    CullUnused=toggle,
    UnifyNormals=toggle,
    FlipNormals=False,
    IdenticalCombine=toggle,
    WeldVertices=Slider(0.0001, range=0..0.0001))

# ---- group: context
clean_3 = CleanTree(RemoveNulls=True, RemoveInvalid=True, RemoveEmpty=False, Tree=rebmsh_2)

# ----
volume_2 = Volume(Geometry=rebmsh)  # -> Volume, Centroid
project_4 = Project(Geometry=graft(volume_2.Centroid), Plane=PlaneXY(0, 0, 0))  # -> Geometry, Transform
ln = Line(StartPoint=graft(volume_2.Centroid), EndPoint=project_4.Geometry)
slx = SurfaceLine(Surface=srf, Line=ln, LimitToFirst=False)  # -> Curves, Points, UVPoints, Normal
ln_2 = Line(StartPoint=slx.Points, EndPoint=graft(volume_2.Centroid))
dist = Distance(PointA=slx.Points, PointB=graft(volume_2.Centroid))
len = Length(Curve=ln)
len_2 = Length(Curve=ln_2)
neg_2 = Negative(Value=len)
addition_3 = Addition(A=dist, B=neg_2)
Z_5 = UnitZ(Factor=addition_3)  # -> flatten(UnitVector)
move_9 = Move(Geometry=rebmsh, Motion=Z_5)  # -> Geometry, Transform

# ----
# Reconstructing Roofs
building_points_2 = Point(building_points)
toggle_2 = BooleanToggle(True)

# ----
# DBSCAN
clean_4 = CleanTree(RemoveNulls=True, RemoveInvalid=True, RemoveEmpty=False, Tree=building_points_2)
density_2 = Number(density)
spacing_2 = Number(spacing)
py3_6 = Python3Script(points_tree=clean_4, density=density_2, spacing=spacing_2)  # -> a; inputs points_tree: tree of Point3d, density: Double, spacing: Double
# ---------- py3_6: Python ----------
import Rhino
import ghpythonlib.treehelpers as th
from sklearn import metrics
from sklearn.cluster import DBSCAN
import rhinoscriptsyntax as rs
import geopandas as gpd
import numpy as np
from scipy import spatial
a = []

for points in th.tree_to_list(points_tree):
    if len(points) == 0: 
        a.append([])
        continue
    
    points_array = np.array(points)

    x_coords = []
    y_coords = []
    z_coords = []

    # Insertions
    for point_ in points:
        x_coords.append(point_.X)
        y_coords.append(point_.Y)
        z_coords.append(point_.Z)

    X = np.stack([x_coords, 
                y_coords, 
                z_coords], axis=1)

    # # find average spacing between points
    # tree = spatial.KDTree(X)
    # distance, index = tree.query(X, k=4)
    # mean_dist = np.mean(distance[:,1:])

    # if mean_dist == np.inf:
    #     continue

    # eps - The maximum distance between two samples for one to be 
    # considered as in the neighborhood of the other.
    db = DBSCAN(eps=2*spacing, min_samples=10).fit(X)
    labels = db.labels_

    # Number of clusters in labels, ignoring noise if present.
    n_clusters_ = len(set(labels)) - (1 if -1 in labels else 0)
    n_noise_ = list(labels).count(-1)

    print("Estimated number of clusters: %d" % n_clusters_)
    print("Estimated number of noise points: %d" % n_noise_)


    a_ = []
    unique_labels = set(labels)

    for k in unique_labels:
        if k == -1:
            continue
        class_member_mask = labels == k
        if points_array[class_member_mask].shape[0] < 3:
            continue

        a_.append(points_array[class_member_mask].tolist())

    a.append(a_)

a = th.list_to_tree(a)
# ---------- end py3_6 ----------

# ---- group: Alpha Shae using mean distnace between all 6 neighbouring points
# Alpha shape 2
py3_7 = Python3Script(points_tree=py3_6)  # -> mean_dists, a, b; inputs points_tree: tree of Point3d
# ---------- py3_7: Python ----------
import Rhino
import ghpythonlib.treehelpers as th
from CGAL import CGAL_Alpha_wrap_3
from CGAL.CGAL_Alpha_wrap_3 import Point_3_Vector
from CGAL.CGAL_Alpha_wrap_3 import Polygon_Vector
from CGAL.CGAL_Alpha_wrap_3 import Int_Vector
from CGAL.CGAL_Polyhedron_3 import Polyhedron_3
from CGAL import CGAL_Polygon_mesh_processing
from CGAL.CGAL_Kernel import Point_3
from CGAL.CGAL_Point_set_3 import Point_set_3
from CGAL.CGAL_Shape_detection import *
from CGAL.CGAL_Point_set_processing_3 import *
from CGAL.CGAL_Advancing_front_surface_reconstruction import *
from CGAL.CGAL_Kernel import Point_2
from CGAL.CGAL_Kernel import Weighted_point_2
from CGAL.CGAL_Alpha_shape_2 import Alpha_shape_2
from CGAL.CGAL_Alpha_shape_2 import Weighted_alpha_shape_2
from CGAL.CGAL_Alpha_shape_2 import Weighted_alpha_shape_2_Face_handle
from CGAL.CGAL_Alpha_shape_2 import GENERAL, EXTERIOR, SINGULAR, REGULAR, INTERIOR
from CGAL.CGAL_Alpha_shape_2 import Alpha_shape_2_Vertex_handle
from CGAL.CGAL_Alpha_shape_2 import Alpha_shape_2_Face_handle
from CGAL.CGAL_Alpha_shape_2 import Face_Interval_3
from scipy import spatial
import rhinoscriptsyntax as rs
import geopandas as gpd
import numpy as np

import System

mean_dists = []
a = []
b = []
for points_t in th.tree_to_list(points_tree):
    a_ = []
    b_ = []
    if points_t is None: continue
    for points in points_t:
        if len(points) == 0: 
            a.append([])
            continue
        
        points_set = Point_set_3()
        lst = []
        z_dict = {}

        x_coords = []
        y_coords = []
        z_coords = []

        # Insertions
        for point_ in points:
            x_coords.append(point_.X)
            y_coords.append(point_.Y)
            z_coords.append(point_.Z)
            lst.append(Point_2(point_.X, point_.Y))
            z_dict[(point_.X, point_.Y)] = point_.Z
        
        X = np.stack([x_coords, 
                      y_coords, 
                      z_coords], axis=1)

        tree = spatial.KDTree(X)
        distance, index = tree.query(X, k=6)
        mean_dist = np.mean(distance[:,1:])
        a_.append(mean_dist)
        if mean_dist < 0.01: 
            continue  
        
        alpha = mean_dist * 2

        t = Alpha_shape_2(lst, EXTERIOR)
        t.clear()
        t.make_alpha_shape(lst)

        mesh_points = {} 
        rs_points = {} 
        counter = 0
        for mesh_point in t.points():
            mesh_points[(mesh_point.x(), mesh_point.y())] = counter
            rs_points[(mesh_point.x(), mesh_point.y())] = (mesh_point.x(), mesh_point.y(), z_dict[(mesh_point.x(), mesh_point.y())])
            counter +=1
        
        mesh_faces = []
        for f in t.finite_faces():
            if t.classify(f, alpha) == EXTERIOR:
                continue
            
            ids = []
            for i in range(3):
                p = t.triangle(f).vertex(i)
                idx = mesh_points[(p.x(), p.y())]
                ids.append(System.Int32(idx))


            mesh_faces.append(tuple(ids))

        test_cells = list(map(tuple, mesh_faces))
        test_points = rs_points.values()
        try:
            rs_mesh = rs.AddMesh(test_points, test_cells)
        except:
            continue

        rs.UnifyMeshNormals(rs_mesh)

        b_.append(rs_mesh)


    a.append(a_)
    b.append(b_)


a = th.list_to_tree(a)
b = th.list_to_tree(b)
# ---------- end py3_7 ----------

# ----
clean_5 = CleanTree(RemoveNulls=True, RemoveInvalid=True, RemoveEmpty=invert(False), Tree=py3_7.a)  # -> graft(Tree)
clean_6 = CleanTree(RemoveNulls=True, RemoveInvalid=True, RemoveEmpty=invert(False), Tree=py3_7.b)  # -> graft(Tree)
remesh = Remesh(Mesh=clean_6, FixEdges=True, EdgeLength=clean_5, Iterations=10, Project=True)
merge_5 = Merge(Data1=remesh, Data2=graft(py3_7.b))
item_8 = ListItem(List=merge_5, Index=0, Wrap=True)
clean_7 = CleanTree(RemoveNulls=True, RemoveInvalid=True, RemoveEmpty=False, Tree=item_8)
trim_6 = TrimTree(Tree=clean_7, Depth=1)
disjoint_2 = DisjointMesh(Mesh=simplify(graft(trim_6)))
demesh = DeconstructMesh(Mesh=disjoint_2)  # -> Vertices, Faces, Colours, Normals
pdecon_3 = Deconstruct(Point=demesh.Vertices)  # -> XComponent, YComponent, ZComponent
conmesh = ConstructMesh(Vertices=demesh.Vertices, Faces=demesh.Faces)  # -> simplify(Mesh)
lng_3 = ListLength(List=demesh.Vertices)
medges = MeshEdges(Mesh=conmesh)  # -> NakedEdges, InteriorEdges, NonManifoldEdges
bnd = Bounds(Numbers=pdecon_3.ZComponent)
line = Line(medges.NakedEdges)
dedomain = DeconstructDomain(Domain=bnd)  # -> Start, End
project_5 = Project(Geometry=line, Plane=PlaneXY(0, 0, 0))  # -> Geometry, Transform
trim_7 = TrimTree(Tree=simplify(dedomain.End), Depth="1")
join = JoinCurves(Curves=project_5.Geometry, Preserve=False)
runion = RegionUnion(Curves=join)
area_4 = Area(Geometry=runion)  # -> Area, Centroid
bnd_2 = Bounds(Numbers=trim_7)  # -> simplify(Domain)
sort = SortList(Keys=area_4.Area)  # -> Keys, ValuesA
dedomain_2 = DeconstructDomain(Domain=bnd_2)  # -> Start, End
item_9 = ListItem(List=reverse(sort.Keys), Index=0, Wrap=True)
subtraction_2 = Subtraction(A=trim_7, B=dedomain_2.Start)  # -> graft(Result)
smaller_2 = SmallerThan(FirstNumber=subtraction_2, SecondNumber=Slider(9.4, range=0..100))  # -> SmallerThan, OrEqualTo
cull_10 = CullPattern(List=item_9, CullPattern=smaller_2.SmallerThan)
cull_11 = CullPattern(List=conmesh, CullPattern=smaller_2.SmallerThan)
larger_2 = LargerThan(FirstNumber=cull_10, SecondNumber=Slider(25, range=0..100))  # -> LargerThan, OrEqualTo
cull_12 = CullPattern(List=cull_10, CullPattern=larger_2.LargerThan)  # -> simplify(List)
cull_13 = CullPattern(List=cull_11, CullPattern=larger_2.LargerThan)
rebmsh_3 = RebuildMesh(
    Mesh=cull_13,
    RebuildNormals=Toggle(True),
    CullUnused=toggle_2,
    UnifyNormals=toggle_2,
    FlipNormals=False,
    IdenticalCombine=toggle_2,
    WeldVertices=Slider(0.0001, range=0..0.0001))
demesh_2 = DeconstructMesh(Mesh=rebmsh_3)  # -> Vertices, Faces, Colours, Normals
conmesh_2 = ConstructMesh(Vertices=demesh_2.Vertices, Faces=demesh_2.Faces, Colours=demesh_2.Normals)  # -> simplify(Mesh)
final_roofs = Mesh(conmesh_2)

trim_8 = TrimTree(Tree=conmesh_2, Depth=1)
move_10 = Move(Geometry=trim_8, Motion=neg)  # -> Geometry, Transform

pt_5 = Point(simplify(demesh_2.Vertices))
path_mapper_2 = PathMapper(pt_5, source="{A;B}", target="{0;A;B}")
path_mapper_3 = PathMapper(pt_5, source="{A}", target="{0;0;A}")
path_mapper_4 = PathMapper(pt_5, source="{A;B;C}", target="{0;A;B}")
path_mapper_5 = PathMapper(cull_12, source="{A;B}", target="{0;A;B}")
path_mapper_6 = PathMapper(cull_12, source="{A}", target="{0;0;A}")
path_mapper_7 = PathMapper(cull_12, source="{A;B;C}", target="{0;A;B}")
lng_4 = ListLength(List=flatten(path_mapper_2))
lng_5 = ListLength(List=flatten(path_mapper_5))
null_3 = NullItem(Item=lng_4)  # -> NullFlags, InvalidFlags, Description
null_4 = NullItem(Item=lng_5)  # -> NullFlags, InvalidFlags, Description
filter = StreamFilter(Gate=null_4.NullFlags, Stream0=path_mapper_5, Stream1=path_mapper_6)
filter_2 = StreamFilter(Gate=null_3.NullFlags, Stream0=path_mapper_2, Stream1=path_mapper_3)
lng_6 = ListLength(List=flatten(filter))
lng_7 = ListLength(List=flatten(filter_2))
null_5 = NullItem(Item=lng_6)  # -> NullFlags, InvalidFlags, Description
null_6 = NullItem(Item=lng_7)  # -> NullFlags, InvalidFlags, Description
filter_3 = StreamFilter(Gate=null_6.NullFlags, Stream0=filter_2, Stream1=path_mapper_4)
filter_4 = StreamFilter(Gate=null_5.NullFlags, Stream0=filter, Stream1=path_mapper_7)
data = Data(filter_3)
data_2 = Data(filter_4)
panel_13 = Panel(data_2)
lng_8 = ListLength(List=data)
final_roofs_2 = Mesh(final_roofs)

# ---- group: Point density per roof
division_3 = Division(A=lng_8, B=data_2)

# ----
sqrt = SquareRoot(Value=division_3)

# ---- group: Point spacing per roof
one_over_x = OneOverX(Value=sqrt)

# ---- group: Input
clean_8 = CleanTree(RemoveNulls=True, RemoveInvalid=True, RemoveEmpty=False, Tree=flatten(final_roofs_2))

# ----
run = BooleanToggle(False)
incidentradiation = LBIncidentRadiation(
    sky_mtx=skymatrix.sky_mtx,
    geometry=flatten(clean_8),
    grid_size=number_slider_6,
    offset_dist=number_slider_5,
    legend_par=legendpar,
    run=run)  # -> report, points, results, total, mesh, legend, title, int_mtx; plug-in component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
incidentradiation_2 = LBIncidentRadiation(
    sky_mtx=skymatrix_2.sky_mtx,
    geometry=flatten(clean_8),
    context=flatten(clean_3),
    grid_size=number_slider_6,
    offset_dist=number_slider_5,
    legend_par=legendpar,
    run=run)  # -> report, points, results, total, mesh, legend, title, int_mtx; plug-in component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
mesh_2 = Mesh(incidentradiation_2.mesh)
addition_4 = Addition(A=incidentradiation.results, B=incidentradiation_2.results)
faceb = FaceBoundaries(Mesh=final_roofs_2)
faceb_2 = FaceBoundaries(Mesh=mesh_2)
area_5 = Area(Geometry=faceb_2)  # -> Area, Centroid
area_6 = Area(Geometry=faceb)  # -> Area, Centroid
rtree = CreateRTree(InputGeometry=area_5.Centroid)
rtree_cp = RTreeClosestPoint(SearchPoints=area_6.Centroid, RTree=rtree)  # -> ClosestPoint, ClosestIndex
num_2 = Number(addition_4)
tstat_5 = TreeStatistics(Tree=area_6.Centroid)  # -> Paths, Length, Count
item_10 = ListItem(List=num_2, Index=rtree_cp.ClosestIndex, Wrap=True)
item_11 = ListItem(List=faceb_2, Index=rtree_cp.ClosestIndex, Wrap=True)
dispatch = Dispatch(List=tstat_5.Paths, DispatchPattern=tstat_5.Length)  # -> ListA, ListB
partition = PartitionList(List=addition_4, Size=1)
branch_5 = TreeBranch(Tree=area_6.Centroid, Path=dispatch.ListB, MaintainPaths=True)
demesh_3 = DeconstructMesh(Mesh=mesh_2)  # -> Vertices, Faces, Colours, Normals
bar_graph = BarGraph(addition_4, BarColor=RGB(255, 0, 90))
repeat = RepeatData(Data=partition, Length=3)  # -> flatten(Data)
merge_6 = Merge(Data1=item_11, Data2=branch_5)
bnd_3 = Bounds(Numbers=repeat)
match_2 = MatchTree(Tree=merge_6, Guide=faceb)
dedomain_3 = DeconstructDomain(Domain=bnd_3)  # -> Start, End
trim_9 = TrimTree(Tree=simplify(match_2), Depth=number_slider_7)
gradient = Gradient(
    LowerLimit=dedomain_3.Start,
    UpperLimit=dedomain_3.End,
    Parameter=repeat,
    stops=[0: RGB(15, 7, 135), 0.255: RGB(79, 2, 162), 0.498: RGB(202, 70, 120), 0.753: RGB(244, 137, 71), 1: RGB(239, 248, 33)])
tstat_6 = TreeStatistics(Tree=trim_9)  # -> Paths, Length, Count
item_12 = ListItem(List=tstat_6.Paths, Index=Slider(0, range=0..100), Wrap=True)
conmesh_3 = ConstructMesh(Vertices=demesh_3.Vertices, Faces=demesh_3.Faces, Colours=gradient)
branch_6 = TreeBranch(Tree=trim_9, Path=item_12, MaintainPaths=True)
disjoint_3 = DisjointMesh(Mesh=conmesh_3)
weld = WeldMesh(Mesh=graft(disjoint_3), Angle=3.141592654)

spacings = Number(one_over_x)
densities = Number(division_3)
densities_2 = Number(densities)
spacings_2 = Number(spacings)
py3_8 = Python3Script(points_tree=data, densities=densities_2, spacings=spacings_2)  # -> a, b; inputs points_tree: tree of Point3d, densities: tree of Double, spacings: tree of Double
# ---------- py3_8: Python ----------
import Rhino
import ghpythonlib.treehelpers as th
from CGAL import CGAL_Alpha_wrap_3
from CGAL.CGAL_Alpha_wrap_3 import Point_3_Vector
from CGAL.CGAL_Alpha_wrap_3 import Polygon_Vector
from CGAL.CGAL_Alpha_wrap_3 import Int_Vector
from CGAL.CGAL_Polyhedron_3 import Polyhedron_3
from CGAL import CGAL_Polygon_mesh_processing
from CGAL.CGAL_Kernel import Point_3
from CGAL.CGAL_Point_set_3 import Point_set_3
from CGAL.CGAL_Shape_detection import *
from CGAL.CGAL_Point_set_processing_3 import *
from CGAL.CGAL_Advancing_front_surface_reconstruction import *
from scipy import spatial
import rhinoscriptsyntax as rs
import geopandas as gpd
import numpy as np

import System

a = []
b = []

for points_t, densities_t, spacings_t in zip(th.tree_to_list(points_tree), 
                                             th.tree_to_list(densities),
                                             th.tree_to_list(spacings)):
    a_ = []
    b_ = []

    if points_t is None:
        a_.append([[[]]])
        b_.append([[[]]])
        a.append(a_)
        b.append(b_)
        continue

    for points, density, spacing in zip(points_t, densities_t, spacings_t):
        if points is None or len(points) == 0: 
            a_.append([[]])
            b_.append([[]])
            continue
        points_set = Point_set_3()

        # x_coords = []
        # y_coords = []
        # z_coords = []

        # Insertions
        for point_ in points:
            idx = points_set.insert(Point_3(point_.X, point_.Y, point_.Z))
            # x_coords.append(point_.X)
            # y_coords.append(point_.Y)
            # z_coords.append(point_.Z)
        

        # X = np.stack([x_coords, 
        #             y_coords, 
        #             z_coords], axis=1)

        # find average spacing between points
        # tree = spatial.KDTree(X)
        # distance, index = tree.query(X, k=10)
        # mean_dist = np.mean(distance[:,1:])

        # if mean_dist == np.inf:
        #     continue

        points_set.add_normal_map()

            #print("Running jet_estimate_normals...")
        jet_estimate_normals(points_set, 10) # Use 10 neighbors

            #print("Running mst_orient_normals...")
        mst_orient_normals(points_set, 10) # Use 10 neighbors

        plane_map = points_set.add_int_map("plane_index") 

        mean_dist = spacing[0]
        eps = spacing[0] / 4 #/ density[0]

        planes = efficient_RANSAC(points_set,
                                    plane_map,
                                    epsilon=eps,
                                    cluster_epsilon=mean_dist,
                                    normal_threshold=eps,)

        points_map = {}
        idx_map = {}
        t = set([idx for idx in points_set.indices()])
        for idx in points_set.indices():
            if idx == 0 : continue
            group = plane_map.get(idx)
            if group not in points_map.keys():
                points_map[group] = []
            if group not in idx_map.keys():
                idx_map[group] = []
            rs_point = rs.AddPoint(points_set.point(idx).x(), 
                                points_set.point(idx).y(), 
                                points_set.point(idx).z())

            points_map[group].append(rs_point)
            idx_map[group].append(idx)


        a_.append([points_map[key] for key in points_map.keys()])
    a.append(a_)
    b.append(b_)
a = th.list_to_tree(a)
b = th.list_to_tree(b)
# ---------- end py3_8 ----------

# ---- group: Adv Roofs
# Alpha shape 2
py3_9 = Python3Script(points_tree=py3_8.a)  # -> mean_dists, a, b; inputs points_tree: tree of Point3d
# ---------- py3_9: Python ----------
import Rhino
import ghpythonlib.treehelpers as th
from CGAL import CGAL_Alpha_wrap_3
from CGAL.CGAL_Alpha_wrap_3 import Point_3_Vector
from CGAL.CGAL_Alpha_wrap_3 import Polygon_Vector
from CGAL.CGAL_Alpha_wrap_3 import Int_Vector
from CGAL.CGAL_Polyhedron_3 import Polyhedron_3
from CGAL import CGAL_Polygon_mesh_processing
from CGAL.CGAL_Kernel import Point_3
from CGAL.CGAL_Point_set_3 import Point_set_3
from CGAL.CGAL_Shape_detection import *
from CGAL.CGAL_Point_set_processing_3 import *
from CGAL.CGAL_Advancing_front_surface_reconstruction import *
from CGAL.CGAL_Kernel import Point_2
from CGAL.CGAL_Kernel import Weighted_point_2
from CGAL.CGAL_Alpha_shape_2 import Alpha_shape_2
from CGAL.CGAL_Alpha_shape_2 import Weighted_alpha_shape_2
from CGAL.CGAL_Alpha_shape_2 import Weighted_alpha_shape_2_Face_handle
from CGAL.CGAL_Alpha_shape_2 import GENERAL, EXTERIOR, SINGULAR, REGULAR, INTERIOR
from CGAL.CGAL_Alpha_shape_2 import Alpha_shape_2_Vertex_handle
from CGAL.CGAL_Alpha_shape_2 import Alpha_shape_2_Face_handle
from CGAL.CGAL_Alpha_shape_2 import Face_Interval_3
from scipy import spatial
import rhinoscriptsyntax as rs
import geopandas as gpd
import numpy as np

import System

mean_dists = []
a = []
b = []
for points_t in th.tree_to_list(points_tree):
    a__ = []
    b__ = []
    if points_t is None:
        a_ = []
        b_ = []
        a__.append(a_)
        b__.append(b_)
        a.append(a__)
        b.append(b__)
        continue

    for points_t_ in points_t:
        a_ = []
        b_ = []
        if points_t_ is None: 
            a__.append(a_)
            b__.append(b_)
            continue
        
        for points in points_t_:
            if points is None: 
                a_.append([])
                continue
            if len(points) == 0: 
                a_.append([])
                continue
            
            points_set = Point_set_3()
            lst = []
            z_dict = {}

            x_coords = []
            y_coords = []
            z_coords = []

            # Insertions
            for point_ in points:
                x_coords.append(point_.X)
                y_coords.append(point_.Y)
                z_coords.append(point_.Z)
                lst.append(Point_2(point_.X, point_.Y))
                z_dict[(point_.X, point_.Y)] = point_.Z
            
            X = np.stack([x_coords, 
                        y_coords, 
                        z_coords], axis=1)

            tree = spatial.KDTree(X)
            distance, index = tree.query(X, k=6)
            mean_dist = np.mean(distance[:,1:])
            a_.append(mean_dist)
            if mean_dist < 0.01: 
                continue  
            
            alpha = mean_dist * 2

            t = Alpha_shape_2(lst, EXTERIOR)
            t.clear()
            t.make_alpha_shape(lst)

            mesh_points = {} 
            rs_points = {} 
            counter = 0
            for mesh_point in t.points():
                mesh_points[(mesh_point.x(), mesh_point.y())] = counter
                rs_points[(mesh_point.x(), mesh_point.y())] = (mesh_point.x(), mesh_point.y(), z_dict[(mesh_point.x(), mesh_point.y())])
                counter +=1
            
            mesh_faces = []
            for f in t.finite_faces():
                if t.classify(f, alpha) == EXTERIOR:
                    continue
                
                ids = []
                for i in range(3):
                    p = t.triangle(f).vertex(i)
                    idx = mesh_points[(p.x(), p.y())]
                    ids.append(System.Int32(idx))


                mesh_faces.append(tuple(ids))

            test_cells = list(map(tuple, mesh_faces))
            test_points = rs_points.values()
            try:
                rs_mesh = rs.AddMesh(test_points, test_cells)
            except:
                b_.append(None)
                
                continue

            rs.UnifyMeshNormals(rs_mesh)

            b_.append(rs_mesh)
        
        a__.append(a_)
        b__.append(b_)

    a.append(a__)
    b.append(b__)

a = th.list_to_tree(a)
b = th.list_to_tree(b)
# ---------- end py3_9 ----------

# ----
# Slope detection
plfit = PlaneFit(Points=py3_8.a)  # -> Plane, Deviation
deplane = DeconstructPlane(Plane=plfit.Plane)  # -> Origin, XAxis, YAxis, ZAxis
Z_6 = UnitZ(Factor=1)
dprod_2 = DotProduct(VectorA=deplane.ZAxis, VectorB=Z_6, Unitize=False)
smaller_3 = SmallerThan(FirstNumber=dprod_2, SecondNumber=0)  # -> SmallerThan, OrEqualTo
cull_14 = CullPattern(List=plfit.Plane, CullPattern=smaller_3.SmallerThan)
cull_15 = CullPattern(List=plfit.Plane, CullPattern=invert(smaller_3.SmallerThan))
flippln = FlipPlane(Plane=cull_15, FlipX=False, FlipY=False, FlipZ=True)  # -> Flipped, R
clean_9 = CleanTree(RemoveNulls=True, RemoveInvalid=True, RemoveEmpty=False, Tree=flippln.Flipped)
mesh_3 = Mesh(graft(py3_9.b))
merge_7 = Merge(Data1=cull_14, Data2=clean_9)
explode_3 = MeshExplode(Mesh=mesh_3, Interpolate=False)
facen_2 = FaceNormals(Mesh=mesh_3)  # -> Centers, Normals
Z_7 = UnitZ(Factor=1)
data_3 = Data(simplify(graft(py3_9.b)))
brec = BoundingRectangle(Geometry=py3_8.a, Plane=merge_7, Axis=0, Slide=0, Union=True)  # -> Bounding, DimensionX, DimensionY
dprod_3 = DotProduct(VectorA=facen_2.Normals, VectorB=Z_7, Unitize=False)
tstat_7 = TreeStatistics(Tree=simplify(data_3))  # -> Paths, Length, Count
larger_3 = LargerThan(FirstNumber=dprod_3, SecondNumber=0)  # -> LargerThan, OrEqualTo
cull_16 = CullPattern(List=explode_3, CullPattern=larger_3.LargerThan)
mjoin_2 = MeshJoin(Meshes=cull_16)
toggle_3 = BooleanToggle(True)
match_3 = MatchTree(Tree=data_3, Guide=simplify(brec.Bounding))
rebmsh_4 = RebuildMesh(
    Mesh=match_3,
    RebuildNormals=Toggle(True),
    CullUnused=toggle_3,
    UnifyNormals=toggle_3,
    FlipNormals=False,
    IdenticalCombine=toggle_3,
    WeldVertices=Slider(0.0001, range=0..0.0001))
demesh_4 = DeconstructMesh(Mesh=rebmsh_4)  # -> Vertices, Faces, Colours, Normals
area_7 = MeshArea(Mesh=rebmsh_4)  # -> graft(Area), Centroid
area_8 = Area(Geometry=brec.Bounding)  # -> Area, Centroid
lng_9 = ListLength(List=demesh_4.Faces)
division_4 = Division(A=lng_9, B=area_8.Area)
panel_14 = Panel(lng_9)
smaller_4 = SmallerThan(FirstNumber=division_4, SecondNumber=Slider(0.1, range=0..10))  # -> SmallerThan, OrEqualTo
cull_17 = CullPattern(List=graft(rebmsh_4), CullPattern=invert(smaller_4.SmallerThan))
cull_18 = CullPattern(List=graft(brec.Bounding), CullPattern=invert(smaller_4.SmallerThan))
area_9 = MeshArea(Mesh=cull_17)  # -> graft(Area), Centroid
larger_4 = LargerThan(FirstNumber=area_9.Area, SecondNumber=Slider(4, range=0..10))  # -> LargerThan, OrEqualTo
cull_19 = CullPattern(List=graft(cull_17), CullPattern=larger_4.LargerThan)
cull_20 = CullPattern(List=graft(cull_18), CullPattern=larger_4.LargerThan)
demesh_5 = DeconstructMesh(Mesh=cull_19)  # -> Vertices, Faces, Colours, Normals
project_6 = Project(Geometry=demesh_5.Vertices, Plane=cull_20)  # -> Geometry, Transform
conmesh_4 = ConstructMesh(Vertices=project_6.Geometry, Faces=demesh_5.Faces)
demesh_6 = DeconstructMesh(Mesh=conmesh_4)  # -> Vertices, Faces, Colours, Normals
conmesh_5 = ConstructMesh(Vertices=demesh_6.Vertices, Faces=demesh_6.Faces, Colours=demesh_6.Normals)
toggle_4 = BooleanToggle(True)
rebmsh_5 = RebuildMesh(
    Mesh=conmesh_5,
    RebuildNormals=Toggle(True),
    CullUnused=toggle_4,
    UnifyNormals=toggle_4,
    FlipNormals=False,
    IdenticalCombine=toggle_4,
    WeldVertices=0)
slopes = Mesh(rebmsh_5)

merge_8 = Merge(Data1=item_10, Data2=branch_5)
match_4 = MatchTree(Tree=merge_8, Guide=faceb)
trim_10 = TrimTree(Tree=simplify(match_4), Depth=number_slider_7)
branch_7 = TreeBranch(Tree=simplify(trim_10), Path=item_12, MaintainPaths=True)
project_7 = Project(Geometry=trim_9, Plane=PlaneXY(0, 0, 0))  # -> Geometry, Transform
bnd_4 = Bounds(Numbers=trim_10)
area_10 = Area(Geometry=trim_9)  # -> Area, Centroid
area_11 = Area(Geometry=project_7.Geometry)  # -> Area, Centroid
ma_4 = MassAddition(Input=trim_10)  # -> Result, PartialResults
dedomain_4 = DeconstructDomain(Domain=bnd_4)  # -> Start, End
ma_5 = MassAddition(Input=area_10.Area)  # -> Result, PartialResults
ma_6 = MassAddition(Input=area_11.Area)  # -> Result, PartialResults
final_roofs_3 = Mesh(final_roofs)
project_8 = Project(Geometry=final_roofs_3, Plane=PlaneXY(0, 0, 0))  # -> Geometry, Transform
clean_10 = CleanTree(RemoveNulls=True, RemoveInvalid=True, RemoveEmpty=invert(False), Tree=project_8.Geometry)
clean_11 = CleanTree(RemoveNulls=True, RemoveInvalid=True, RemoveEmpty=False, Tree=project_8.Geometry)

# ----
# Average Shortest distance between corner points
# and laser points [m]
demesh_7 = DeconstructMesh(Mesh=clean_10)  # -> Vertices, Faces, Colours, Normals
trim_11 = TrimTree(Tree=simplify(demesh_7.Vertices), Depth=1)
tstat_8 = TreeStatistics(Tree=trim_11)  # -> Paths, Length, Count
branch_8 = TreeBranch(Tree=simplify(footprints_2), Path=tstat_8.Paths, MaintainPaths=True)
rtree_2 = CreateRTree(InputGeometry=trim_11)
explode_4 = Explode(Curve=branch_8, Recursive=True)  # -> Segments, Vertices
rtree_cp_2 = RTreeClosestPoint(SearchPoints=explode_4.Vertices, RTree=rtree_2)  # -> ClosestPoint, ClosestIndex
ln_3 = Line(StartPoint=rtree_cp_2.ClosestPoint, EndPoint=flatten(explode_4.Vertices))
ln_4 = Line(StartPoint=flatten(explode_4.Vertices), EndPoint=rtree_cp_2.ClosestPoint)
match_5 = MatchTree(Tree=graft(ln_4), Guide=graft(explode_4.Vertices))  # -> simplify(Tree)
trim_12 = TrimTree(Tree=match_5, Depth=1)
len_3 = Length(Curve=trim_12)
avr_6 = Average(Input=len_3)
panel_15 = Panel(avr_6)

# ----
# Fraction of misscflassified buildings
branch_9 = TreeBranch(Tree=simplify(footprints_2), Path=tstat_8.Paths, MaintainPaths=True)
tstat_9 = TreeStatistics(Tree=footprints_2)  # -> Paths, Length, Count
tstat_10 = TreeStatistics(Tree=branch_9)  # -> Paths, Length, Count
lng_10 = ListLength(List=tstat_9.Paths)
lng_11 = ListLength(List=tstat_10.Paths)
division_5 = Division(A=lng_11, B=lng_10)
panel_16 = Panel(division_5)

trim_13 = TrimTree(Tree=simplify(clean_11), Depth=1)
clean_12 = CleanTree(RemoveNulls=True, RemoveInvalid=True, RemoveEmpty=False, Tree=plfit.Deviation)

# ----
# Fraction of the building footprint area and
# projected reconstructed roof area
# tells us amount of area not containing points
area_12 = MeshArea(Mesh=clean_11)  # -> Area, Centroid
area_13 = Area(Geometry=branch_8)  # -> Area, Centroid
trim_14 = TrimTree(Tree=simplify(area_12.Area), Depth=1)
ma_7 = MassAddition(Input=area_13.Area)  # -> Result, PartialResults
ma_8 = MassAddition(Input=trim_14)  # -> Result, PartialResults
subtraction_3 = Subtraction(A=ma_7.Result, B=ma_8.Result)
division_6 = Division(A=ma_8.Result, B=ma_7.Result)
avr_7 = Average(Input=flatten(division_6))  # -> simplify(ArithmeticMean)
panel_17 = Panel(division_6)

sqr = Square(Value=clean_12)
slopes_2 = Mesh(simplify(slopes))
tstat_11 = TreeStatistics(Tree=trim_13)  # -> Paths, Length, Count
trim_15 = TrimTree(Tree=slopes_2, Depth=2)
equals = Equality(FirstNumber=tstat_11.Length, SecondNumber=0)  # -> Equality, Inequality

# ---- group: numSeg
lng_12 = ListLength(List=trim_15)

# ----
panel_18 = Panel(lng_12)
equals_2 = Equality(FirstNumber=lng_12, SecondNumber=1)  # -> Equality, Inequality
cull_21 = CullPattern(List=lng_12, CullPattern=invert(equals_2.Equality))
clean_13 = CleanTree(RemoveNulls=True, RemoveInvalid=True, RemoveEmpty=False, Tree=cull_21)
cull_22 = CullPattern(List=tstat_11.Paths, CullPattern=equals.Equality)

# ---- group: maxSunshineHoursPerYear
num_3 = Number(dedomain_4.End)

# ----
nullrep_3 = ReplaceNulls(Items=num_3, Replacements="0")  # -> Items, Count
panel_19 = Panel(nullrep_3.Items)
clean_14 = CleanTree(RemoveNulls=True, RemoveInvalid=True, RemoveEmpty=False, Tree=nullrep_3.Items)
branch_10 = TreeBranch(Tree=trim_13, Path=cull_22, MaintainPaths=True)

# ---- group: totSunshineHoursPerYear
num_4 = Number(ma_4.Result)

# ----
nullrep_4 = ReplaceNulls(Items=num_4, Replacements="0")  # -> Items, Count
panel_20 = Panel(nullrep_4.Items)
clean_15 = CleanTree(RemoveNulls=True, RemoveInvalid=True, RemoveEmpty=False, Tree=nullrep_4.Items)

# ---- group: areaMeters2
num_5 = Number(ma_5.Result)

# ----
nullrep_5 = ReplaceNulls(Items=num_5, Replacements="0")  # -> Items, Count
panel_21 = Panel(nullrep_5.Items)
clean_16 = CleanTree(RemoveNulls=True, RemoveInvalid=True, RemoveEmpty=False, Tree=nullrep_5.Items)

# ---- group: groundAreaMeters2
num_6 = Number(ma_6.Result)

# ----
nullrep_6 = ReplaceNulls(Items=num_6, Replacements="0")  # -> Items, Count
panel_22 = Panel(nullrep_6.Items)
clean_17 = CleanTree(RemoveNulls=True, RemoveInvalid=True, RemoveEmpty=False, Tree=nullrep_6.Items)

# ----
# Arranging PV Panels
drec_2 = DeconstuctRectangle(Rectangle=cull_20)  # -> BasePlane, XInterval, YInterval
dedomain_5 = DeconstructDomain(Domain=drec_2.YInterval)  # -> Start, End
dedomain_6 = DeconstructDomain(Domain=drec_2.XInterval)  # -> Start, End
abs = Absolute(Value=dedomain_6.Start)
abs_2 = Absolute(Value=dedomain_6.End)
abs_3 = Absolute(Value=dedomain_5.Start)
abs_4 = Absolute(Value=dedomain_5.End)
addition_5 = Addition(A=abs_3, B=abs_4)
addition_6 = Addition(A=abs, B=abs_2)
rotate = Rotate(Geometry=cull_20, Angle=1.570796327, Plane=cull_20)  # -> Geometry, Transform
larger_5 = LargerThan(FirstNumber=addition_5, SecondNumber=addition_6)  # -> LargerThan, OrEqualTo
cull_23 = CullPattern(List=addition_5, CullPattern=invert(larger_5.LargerThan))
cull_24 = CullPattern(List=addition_5, CullPattern=larger_5.LargerThan)
cull_25 = CullPattern(List=addition_6, CullPattern=invert(larger_5.LargerThan))
cull_26 = CullPattern(List=addition_6, CullPattern=larger_5.LargerThan)
cull_27 = CullPattern(List=cull_20, CullPattern=invert(larger_5.LargerThan))
cull_28 = CullPattern(List=rotate.Geometry, CullPattern=larger_5.LargerThan)
merge_9 = Merge(Data1=cull_24, Data2=cull_25)
merge_10 = Merge(Data1=cull_23, Data2=cull_26)
merge_11 = Merge(Data1=cull_27, Data2=cull_28)
division_7 = Division(A=merge_9, B=panel_9)
division_8 = Division(A=merge_10, B=panel_10)
multiplication_2 = Multiplication(A=panel_9, B=panel_10)
round = Round(Number=division_7)  # -> Nearest, Floor, Ceiling
round_2 = Round(Number=division_8)  # -> Nearest, Floor, Ceiling
recgrid = Rectangular(Plane=merge_11, SizeX=panel_9, SizeY=panel_10, ExtentX=round.Floor, ExtentY=round_2.Floor)  # -> Cells, Points
nakededge = MeshNakedEdge(Mesh=rebmsh_5)  # -> V, A, B
trim_16 = TrimTree(Tree=recgrid.Cells, Depth=1)
item_13 = ListItem(List=nakededge.V, Index=nakededge.A, Wrap=True)
item_14 = ListItem(List=nakededge.V, Index=nakededge.B, Wrap=True)
ln_5 = Line(StartPoint=item_13, EndPoint=item_14)
clean_18 = CleanTree(RemoveNulls=True, RemoveInvalid=True, RemoveEmpty=False, Tree=trim_16)
brec_2 = BoundingRectangle(Geometry=clean_18, Plane=drec_2.BasePlane, Axis=0, Slide=0, Union=True)  # -> Bounding, DimensionX, DimensionY
join_2 = JoinCurves(Curves=ln_5, Preserve=False)
offset_l = OffsetCurveLoose(Curve=join_2, Distance="-0.25", Plane=cull_20)
drec_3 = DeconstuctRectangle(Rectangle=brec_2.Bounding)  # -> BasePlane, XInterval, YInterval
project_9 = Project(Geometry=offset_l, Plane=drec_2.BasePlane)  # -> Geometry, Transform
vec2pt_2 = Vector2Pt(PointA=drec_3.BasePlane, PointB=drec_2.BasePlane, Unitize=False)  # -> Vector, Length
move_11 = Move(Geometry=trim_16, Motion=vec2pt_2.Vector)  # -> Geometry, Transform
match_6 = MatchTree(Tree=project_9.Geometry, Guide=move_11.Geometry)
ccx = CurveCurve(CurveA=move_11.Geometry, CurveB=match_6)  # -> Points, ParamsA, ParamsB
clscrv = CloseCurve(Curve=match_6, CloseType=0, Bulge=0.5, Tolerance=0)  # -> Closed, R
lng_13 = ListLength(List=ccx.ParamsA)
equals_3 = Equality(FirstNumber=lng_13, SecondNumber=0)  # -> Equality, Inequality
trim_17 = TrimTree(Tree=equals_3.Equality, Depth=1)
cull_29 = CullPattern(List=move_11.Geometry, CullPattern=trim_17)
drec_4 = DeconstuctRectangle(Rectangle=move_11.Geometry)  # -> BasePlane, XInterval, YInterval
area_14 = Area(Geometry=cull_29)  # -> Area, Centroid
incurve = PointInCurve(Point=area_14.Centroid, Curve=clscrv.Closed)  # -> Relationship, Point
meshcp = MeshClosestPoint(Point=area_14.Centroid, Mesh=rebmsh_5)  # -> Point, Index, Parameter
dist_2 = Distance(PointA=area_14.Centroid, PointB=meshcp.Point)
larger_6 = LargerThan(FirstNumber=dist_2, SecondNumber=Slider(0.5, range=0..1))  # -> LargerThan, OrEqualTo
number_slider_10 = Slider(1, range=0..1)
cull_30 = CullPattern(List=cull_29, CullPattern=invert(larger_6.LargerThan))
mesh_uv = MeshSurface(Surface=cull_30, UCount=number_slider_10, VCount=number_slider_10, Overhang=True, Equalize=False)
flip_2 = MeshFlip(Mesh=mesh_uv)
trim_18 = TrimTree(Tree=simplify(flip_2), Depth=1)
solar_panels = Mesh(trim_18)

solar_panels_2 = Mesh(solar_panels)

# ---- group: Input
clean_19 = CleanTree(RemoveNulls=True, RemoveInvalid=True, RemoveEmpty=False, Tree=flatten(solar_panels_2))

# ---- group: Panel Area
num_7 = Number(multiplication_2)

num_8 = Number(num_7)

# ----
division_9 = Division(A=panel_4, B=num_8)

run_2 = BooleanToggle(False)
incidentradiation_3 = LBIncidentRadiation(
    sky_mtx=skymatrix.sky_mtx,
    geometry=flatten(clean_19),
    grid_size=number_slider_4,
    offset_dist=number_slider_3,
    legend_par=legendpar,
    run=run_2)  # -> report, points, results, total, mesh, legend, title, int_mtx; plug-in component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
incidentradiation_4 = LBIncidentRadiation(
    sky_mtx=skymatrix_2.sky_mtx,
    geometry=flatten(clean_19),
    context=flatten(clean_3),
    grid_size=number_slider_4,
    offset_dist=number_slider_3,
    legend_par=legendpar,
    run=run_2)  # -> report, points, results, total, mesh, legend, title, int_mtx; plug-in component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
mesh_4 = Mesh(incidentradiation_4.mesh)
addition_7 = Addition(A=incidentradiation_3.results, B=incidentradiation_4.results)
faceb_3 = FaceBoundaries(Mesh=mesh_4)
faceb_4 = FaceBoundaries(Mesh=solar_panels_2)
area_15 = Area(Geometry=faceb_3)  # -> Area, Centroid
area_16 = Area(Geometry=faceb_4)  # -> Area, Centroid
rtree_3 = CreateRTree(InputGeometry=area_15.Centroid)
rtree_cp_3 = RTreeClosestPoint(SearchPoints=area_16.Centroid, RTree=rtree_3)  # -> ClosestPoint, ClosestIndex
tstat_12 = TreeStatistics(Tree=area_16.Centroid)  # -> Paths, Length, Count
num_9 = Number(addition_7)
dispatch_2 = Dispatch(List=tstat_12.Paths, DispatchPattern=tstat_12.Length)  # -> ListA, ListB
item_15 = ListItem(List=num_9, Index=rtree_cp_3.ClosestIndex, Wrap=True)
item_16 = ListItem(List=faceb_3, Index=rtree_cp_3.ClosestIndex, Wrap=True)
partition_2 = PartitionList(List=addition_7, Size=1)
branch_11 = TreeBranch(Tree=area_16.Centroid, Path=dispatch_2.ListB, MaintainPaths=True)
demesh_8 = DeconstructMesh(Mesh=mesh_4)  # -> Vertices, Faces, Colours, Normals
bar_graph_2 = BarGraph(addition_7, BarColor=RGB(255, 0, 90))
repeat_2 = RepeatData(Data=partition_2, Length=4)  # -> flatten(Data)
merge_12 = Merge(Data1=item_16, Data2=branch_11)
bnd_5 = Bounds(Numbers=repeat_2)
match_7 = MatchTree(Tree=merge_12, Guide=faceb_4)
dedomain_7 = DeconstructDomain(Domain=bnd_5)  # -> Start, End
gradient_2 = Gradient(
    LowerLimit=dedomain_7.Start,
    UpperLimit=dedomain_7.End,
    Parameter=repeat_2,
    stops=[0: RGB(15, 7, 135), 0.255: RGB(79, 2, 162), 0.498: RGB(202, 70, 120), 0.753: RGB(244, 137, 71), 1: RGB(239, 248, 33)])
conmesh_6 = ConstructMesh(Vertices=demesh_8.Vertices, Faces=demesh_8.Faces, Colours=gradient_2)
disjoint_4 = DisjointMesh(Mesh=conmesh_6)
weld_2 = WeldMesh(Mesh=graft(disjoint_4), Angle=3.141592654)

area_17 = Area(Geometry=item_16)  # -> Area, Centroid
multiplication_3 = Multiplication(A=panel_4, B=item_15)
merge_13 = Merge(Data1=multiplication_3, Data2=branch_11)
multiplication_4 = Multiplication(A=item_15, B=division_9)
match_8 = MatchTree(Tree=merge_13, Guide=faceb_4)
path_mapper_8 = PathMapper(match_8, source=["{A;B;C;D;E}", "{A;B;C}"], target=["{A;B;C;D;E}", "{A;B;C;0;0}"])
path_mapper_9 = PathMapper(match_7, source=["{A;B;C;D;E}", "{A;B;C}"], target=["{A;B;C;D;E}", "{A;B;C;0;0}"])
trim_19 = TrimTree(Tree=simplify(path_mapper_8), Depth=3)

trim_20 = TrimTree(Tree=simplify(path_mapper_9), Depth=3)
tstat_13 = TreeStatistics(Tree=trim_20)  # -> Paths, Length, Count
item_17 = ListItem(List=tstat_13.Paths, Index=Slider(10, range=0..100), Wrap=True)
branch_12 = TreeBranch(Tree=trim_20, Path=item_17, MaintainPaths=True)

area_18 = Area(Geometry=trim_20)  # -> Area, Centroid

# ---- group: maxYearlyEnergyDcKwh
ma_9 = MassAddition(Input=trim_19)  # -> Result, PartialResults

# ----
nullrep_7 = ReplaceNulls(Items=ma_9.Result, Replacements="0")  # -> Items, Count
panel_23 = Panel(nullrep_7.Items)
clean_20 = CleanTree(RemoveNulls=True, RemoveInvalid=True, RemoveEmpty=False, Tree=nullrep_7.Items)

# ---- group: maxArrayPanelsCount
lng_14 = ListLength(List=area_18.Area)

# ----
equals_4 = Equality(FirstNumber=lng_14, SecondNumber=0)  # -> Equality, Inequality
cull_31 = CullPattern(List=lng_14, CullPattern=invert(equals_4.Equality))
panel_24 = Panel(lng_14)
clean_21 = CleanTree(RemoveNulls=True, RemoveInvalid=True, RemoveEmpty=False, Tree=cull_31)

# ---- group: maxArrayAreaMeters2
ma_10 = MassAddition(Input=area_18.Area)  # -> Result, PartialResults

# ----
nullrep_8 = ReplaceNulls(Items=ma_10.Result, Replacements="0")  # -> Items, Count
panel_25 = Panel(nullrep_8.Items)
clean_22 = CleanTree(RemoveNulls=True, RemoveInvalid=True, RemoveEmpty=False, Tree=nullrep_8.Items)
merge_14 = Merge(
    Data1=lng_14,
    Data2=nullrep_8.Items,
    Data3=lng_12,
    Data4=nullrep_3.Items,
    Data5=nullrep_4.Items,
    Data6=nullrep_5.Items,
    Data7=nullrep_6.Items,
    Data8=nullrep_7.Items,
    Data9=nullrep_2.Items,
    Data10=nullrep.Items,
    Data11=item_4.Item,
    Data12=item_4.Item1)
flip_3 = FlipMatrix(Data=merge_14)
csv_2 = CreateCSV(DataGridHeaders=merge, ValueTree=flip_3, Delimiter=",")
panel_26 = Panel(csv_2)

# ----
# RMSE orthogonal differences between
# roof plane and laser points
# [m]
number_slider_11 = Slider(2, range=0..10)
pow = Power(A=clean_12, B=number_slider_11)  # -> flatten(Result)

trim_21 = TrimTree(Tree=simplify(sqr), Depth=number_slider_11)
avr_8 = Average(Input=trim_21)

ma_11 = MassAddition(Input=trim_21)  # -> Result, PartialResults
lng_15 = ListLength(List=trim_21)
division_10 = Division(A=ma_11.Result, B=lng_15)
sqrt_2 = SquareRoot(Value=division_10)
panel_27 = Panel(avr_8)

rmse = Panel(panel_27)
avg_frac_footprints_not_covered = Panel(panel_17)
avg_shortest_dist_to_corner = Panel(panel_15)
tree_points_inside_footprint = Panel(panel_11)
fac_of_missclassified_buldings = Panel(panel_16)

merge_15 = Merge(
    Data1=rmse,
    Data2=avg_frac_footprints_not_covered,
    Data3=avg_shortest_dist_to_corner,
    Data4=tree_points_inside_footprint,
    Data5=clean_20,
    Data6=clean_21,
    Data7=clean_22,
    Data8=clean_13,
    Data9=clean_14,
    Data10=clean_15,
    Data11=clean_16,
    Data12=clean_17)
flip_4 = FlipMatrix(Data=merge_15)
csv_3 = CreateCSV(DataGridHeaders=merge_2, ValueTree=flip_4, Delimiter=",")
panel_28 = Panel(csv_3)
