# Grasshopper definition PV Solar Potential Assesment Framework.gh (Grasshopper 1.0.8)
# plug-ins: RhinoCodePluginGH, MeshEdit Components, Pufferfish, NGon, LunchBox

pointcloud_crs = Integer("6350")

# ----
# Step 1. Request LiDAR and
# Building Footprint Data
# Define Bounding Box Coordinates
panel = Panel("-84.37984, 33.77699, -84.37850, 33.77819")

out_crs = Integer("26916")

panel_2 = Panel("D:\GATECH\HPBL\sigradi\GitHub\Assessing-Solar-Potential-of-Buildings-Using-LiDAR-and-Footprint-Data\Code\Grasshopper\data\Atlanta_33.77_-84.3824_2021.epw")
nrel_weather_data_file_path = FilePath(panel_2)

panel_3 = Panel("D:\GATECH\HPBL\sigradi\GitHub\Assessing-Solar-Potential-of-Buildings-Using-LiDAR-and-Footprint-Data\Code\Grasshopper\data\")
temp_path = Text(panel_3)

# ----
# Check directories of current
# python environments
# Instructions for installing
# packages
# Go to
# C:\Users\%UserName%\.rhinocode\py39-rh8\Scripts
# 
# with command prompt run:
# 
# cd "C:\Users\%UserName%\.rhinocode\py39-rh8\Scripts"
# 
# to install packages:
# 
# pip install laspy[lazrs,laszip]
# pip install geopy
# pip install scikit-learn
# pip install scipy
# pip install cgal
# pip install requests
# pip install rasterio
# pip install laspy
# pip install geopandas
# pip install osmnx
# 
# Close Rhino
# 
# Open Rhino and, before starting Grashopper, run ScriptEditor command and run
# 
# import locale
# locale.setlocale(locale.LC_ALL, 'en_US')
# import pandas as pd
# import laspy
S = Script()  # -> out, a
# ---------- S: Python ----------
import sys
a = sys.path
# ---------- end S ----------
panel_4 = Panel(S.a)

out_crs_2 = Integer(out_crs)
pt = Point(Point(0, 0, 0))
split = TextSplit(Text=panel, Separators=",")
num = Number(split)
item = ListItem(List=num, Index=0, Wrap=True)  # -> Item, Item1, Item2, Item3
xmin = Number(item.Item)
xmin_2 = Number(xmin)
ymin = Number(item.Item1)
ymin_2 = Number(ymin)
xmax = Number(item.Item2)
xmax_2 = Number(xmax)
ymax = Number(item.Item3)
ymax_2 = Number(ymax)
bbox = Script(xmin=xmin_2, ymin=ymin_2, xmax=xmax_2, ymax=ymax_2, out_crs=out_crs_2)  # -> bbox; inputs xmin: Double, ymin: Double, xmax: Double, ymax: Double
# ---------- bbox: Python ----------
import requests
import json
import geopandas as gpd
import os 
import rhinoscriptsyntax as rs
from pyproj import Transformer
import numpy as np

points =np.array([[xmin, ymin],
                  [xmax, ymin],
                  [xmax, ymax],
                  [xmin, ymax],
                  [xmin, ymin]])

transformer = Transformer.from_crs(crs_from="EPSG:4326", crs_to=f"EPSG:{out_crs}")

points0_t, points1_t = transformer.transform(points[:,1], points[:,0])

bbox = rs.AddPolyline([rs.AddPoint(points0_t[0], points1_t[0]),
                       rs.AddPoint(points0_t[1], points1_t[1]),
                       rs.AddPoint(points0_t[2], points1_t[2]),
                       rs.AddPoint(points0_t[3], points1_t[3]),
                       rs.AddPoint(points0_t[0], points1_t[0])])

print(points0_t[0], points1_t[0], points0_t[2], points1_t[2])
# ---------- end bbox ----------
item_2 = ListItem(List=flatten(bbox), Index=0, Wrap=True)
drec = DeconstuctRectangle(Rectangle=item_2)  # -> BasePlane, XInterval, YInterval
pt_2 = Point(drec.BasePlane)
vec2pt = Vector2Pt(PointA=pt_2, PointB=pt, Unitize=False)  # -> Vector, Length
move = Move(Geometry=bbox, Motion=vec2pt.Vector)  # -> Geometry, Transform
translation = Vector(vec2pt.Vector)
bbox_2 = Curve(move.Geometry)
temp_path_2 = Text(temp_path)
translation_2 = Vector(translation)
xmin_3 = Number(xmin)
ymin_3 = Number(ymin)
xmax_3 = Number(xmax)
ymax_3 = Number(ymax)
out_crs_3 = Integer(out_crs)
bbox_3 = Curve(bbox_2)
tstat = TreeStatistics(Tree=xmin_3)  # -> Paths, Length, Count
dpath = DeconstructPath(Branch=tstat.Paths)
item_3 = ListItem(List=dpath, Index=0, Wrap=True)
buildings_osm = Script(xmin=xmin_3, ymin=ymin_3, xmax=xmax_3, ymax=ymax_3, temp_path=temp_path_2, out_crs=out_crs_3, tree_level=item_3)  # -> buildings, footprints, locations, xmin_new, ymin_new, xmax_new, ymax_new; inputs xmin: Double, ymin: Double, xmax: Double, ymax: Double, temp_path: String, tree_level: Int32
# ---------- buildings_osm: Python ----------
import requests
import json
import geopandas as gpd
import os 
import rhinoscriptsyntax as rs
from pyproj import Transformer
import ghpythonlib.treehelpers as th
import osmnx as ox

ox.config(use_cache=True, cache_folder=temp_path + "osm_cache")

def request_data_by_bbox(xmin, ymin, xmax, ymax, out_crs):
    tags = {"building": True}
    print(type(tags))
    result = ox.features.features_from_bbox(ymax, ymin, xmax, xmin, tags=tags)
    return result.to_crs(out_crs)

file_name = temp_path + f'EPSG{out_crs} - {xmin}, {ymin}, {xmax}, {ymax} ' + 'OSM_buildings.json'

if os.path.isfile(file_name):
    buildings = gpd.read_file(file_name, driver="GeoJSON")
else:
    buildings_gpd = request_data_by_bbox(xmin, ymin, xmax, ymax, out_crs)
    buildings_gpd[["geometry"]].to_file(file_name, driver="GeoJSON")

    buildings = gpd.read_file(file_name)
    buildings = buildings.to_crs(out_crs)

footprints = []
locations = []

for i in range(buildings.shape[0]):
    footprint = []
    building = buildings.iloc[i]
    if building.geometry.type == "Point": continue
    exterior = rs.AddPolyline([rs.AddPoint(coord[0], coord[1], ) for coord in building.geometry.exterior.coords])
    footprint.append(exterior)
    
    for interior in buildings.iloc[i].geometry.interiors:
        footprint.append(rs.AddPolyline([rs.AddPoint(coord[0], coord[1], ) for coord in interior.coords]))
    
    footprints.append(footprint)

    transformer_loc = Transformer.from_crs(f"EPSG:{out_crs}", "EPSG:4326", always_xy=True)
    location = transformer_loc.transform(building.geometry.centroid.x, building.geometry.centroid.y)
    locations.append([location[0], location[1]])



transformer = Transformer.from_crs("EPSG:4326", f"EPSG:{out_crs}", always_xy=True)

xmin_t, ymin_t = transformer.transform(xmin, ymin)
xmax_t, ymax_t = transformer.transform(xmax, ymax)

xmin_t = xmin_t# - 70
ymin_t = ymin_t# - 70
xmax_t = xmax_t# + 70
ymax_t = ymax_t# + 70

transformer = Transformer.from_crs(f"EPSG:{out_crs}", "EPSG:4326", always_xy=True)

xmin_new, ymin_new = transformer.transform(xmin_t, ymin_t)
xmax_new, ymax_new = transformer.transform(xmax_t, ymax_t)

footprints = th.list_to_tree(footprints, source=[tree_level])
locations = th.list_to_tree(locations, source=[tree_level])
# ---------- end buildings_osm ----------
pointcloud_crs_2 = Integer(pointcloud_crs)
temp_path_3 = Text(temp_path)
xmin_4 = Number(buildings_osm.xmin_new)
ymin_4 = Number(buildings_osm.ymin_new)
xmax_4 = Number(buildings_osm.xmax_new)
ymax_4 = Number(buildings_osm.ymax_new)
out_crs_4 = Integer(out_crs)
move_2 = Move(Geometry=buildings_osm.footprints, Motion=translation_2)  # -> Geometry, Transform
lidar = Python3Script(
    xmin=xmin_4,
    ymin=ymin_4,
    xmax=xmax_4,
    ymax=ymax_4,
    temp_path=temp_path_3,
    out_crs=out_crs_4,
    pointcloud_crs=pointcloud_crs_2)  # -> scan; inputs temp_path: String
# ---------- lidar: Python ----------
import requests
import laspy
import os
import numpy as np
from pyproj import Transformer
from urllib.request import urlretrieve
import json

def request_data_by_bbox(xmin, ymin, xmax, ymax):
    params = {
            'datasets':  'Lidar Point Cloud (LPC)',
            'bbox': f'{xmin}, {ymin}, {xmax}, {ymax}',
            'outputFormat': 'JSON'
    }

    r = requests.get('https://tnmaccess.nationalmap.gov/api/v1/products?', params)

    r_json =  r.json()

    newest = max([item['publicationDate'] for item in r_json['items']])

    return [item['downloadLazURL'] for item in r_json['items'] if item['publicationDate'] == newest]


file_name = temp_path + \
    f'pc_crs EPSG {pointcloud_crs}, out_crs EPSG {out_crs}, bbox {xmin}, {ymin}, {xmax}, {ymax} ' + 'LiDAR_merged.las'

if os.path.isfile(file_name):
    scan = laspy.read(file_name)

else:
    try:
        if temp_path:
            lidar_urls = request_data_by_bbox(xmin, ymin, xmax, ymax)
        else:
            lidar_urls = []  
    except:
        lidar_urls = []                

    # Save data locally
    for url in lidar_urls:
        if os.path.isfile(temp_path + url.rpartition('/')[-1]):
            continue
        else:
            urlretrieve(url, temp_path + url.rpartition('/')[-1])

    all_scan_points_arrays = []
    all_scan_xyzs = []

    transformer = Transformer.from_crs("EPSG:4326",  f"EPSG:{out_crs}", always_xy=True)
    xmin_t, ymin_t = transformer.transform(xmin, ymin)
    xmax_t, ymax_t = transformer.transform(xmax, ymax)

    # Read all the scans
    for url in lidar_urls:
        scan = laspy.read(temp_path + url.rpartition('/')[-1])

        transformed_coords = (scan.xyz[:,0], scan.xyz[:,1], scan.xyz[:,2])
        
        if pointcloud_crs != out_crs:
            # The EPGS code for NAD83(2011) / Conus Albers is 6350
            # The EPGS code for WGS84 is 4326
            transformer2 = Transformer.from_crs(f"EPSG:{pointcloud_crs}", f"EPSG:{out_crs}", always_xy=False)
            transformed_coords = transformer2.transform(scan.xyz[:,0], scan.xyz[:,1], scan.xyz[:,2])

        # We now need to filter by world coordinates bounding box so we get 
        # the points only for our area of interest. Lets inspect in what 
        # coordinate system are the scans.

        mask = ((transformed_coords[0] > xmin_t) & (transformed_coords[0] < xmax_t) &
                            (transformed_coords[1] > ymin_t) & (transformed_coords[1] < ymax_t))

        filtered_scan = scan[mask]

        # transformer = Transformer.from_crs("EPSG:6350", f"EPSG:{out_crs}")

        # lidar_sample = transformer.transform(filtered_scan.points.x, 
        #                                      filtered_scan.points.y, 
        #                                      filtered_scan.points.z)
                                    
        filtered_scan.xyz[:,0] = transformed_coords[0][mask]
        filtered_scan.xyz[:,1] = transformed_coords[1][mask]
        filtered_scan.xyz[:,2] = transformed_coords[2][mask]

        all_scan_xyzs.append(np.stack([transformed_coords[0][mask], 
                                    transformed_coords[1][mask], 
                                    transformed_coords[2][mask]], axis=1))

        # filtered_scan.points.x = transformed_coords[0][mask]
        # filtered_scan.points.y = transformed_coords[1][mask]
        # filtered_scan.points.z = transformed_coords[2][mask]
        all_scan_points_arrays.append(filtered_scan.points.array)
        

    # Merge into one dataset
    all_scan_points = np.concatenate(all_scan_points_arrays)
    all_scan_xyz = np.concatenate(all_scan_xyzs)

    scan = laspy.create(point_format=scan.header.point_format, file_version=scan.header.version)
    scan.points.array = all_scan_points
    scan.xyz = all_scan_xyz
    scan.write(file_name)
# ---------- end lidar ----------
colom = CollisionOneMany(Collider=bbox_3, Obstacles=move_2.Geometry)  # -> Collision, Index
xmin_5 = Number(xmin)
cull = CullPattern(List=move_2.Geometry, CullPattern=invert(colom.Collision))
tstat_2 = TreeStatistics(Tree=xmin_5)  # -> Paths, Length, Count
out_crs_5 = Integer(out_crs)
dpath_2 = DeconstructPath(Branch=tstat_2.Paths)
out_crs_6 = Integer(out_crs)
clean = CleanTree(RemoveNulls=True, RemoveInvalid=True, RemoveEmpty=invert(False), Tree=cull)  # -> simplify(Tree)
translation_3 = Vector(translation)

# ---- group: scan to GeoDataFrame
project = Script(scan=lidar, out_crs=out_crs_5)  # -> buildings_scan_pts_gpd, density, spacing
# ---------- project: Python ----------
import numpy as np
import geopandas as gpd
import rasterio as rio
import numpy as np
import laspy

buildings = laspy.create(
    point_format=scan.header.point_format, 
    file_version=scan.header.version)

points_to_calc = scan.points[#(scan.number_of_returns == 1) & 
                             (scan.return_number == 1)]

width =  np.max(points_to_calc.x) - np.min(points_to_calc.x)
height = np.max(points_to_calc.y) - np.min(points_to_calc.y)

rt = scan.number_of_returns
rt2 = scan.return_number
over = scan.overlap
bbox_area = width * height

density =  points_to_calc.array.shape[0] / bbox_area
spacing = 1.5 / np.sqrt(density)

buildings.points = scan.points[(scan.classification == 6)]# &
                               #(scan.number_of_returns == 1) & 
                               #(scan.return_number == 1)]

buildings_pts = np.stack([buildings.points.x, 
                          buildings.points.y, 
                          buildings.points.z], axis=1)


buildings_scan_pts_gpd = gpd.points_from_xy(buildings_pts[:,0], buildings_pts[:,1])


d = {'geometry': buildings_scan_pts_gpd}
buildings_scan_pts_gpd = gpd.GeoDataFrame(d, crs=f"EPSG:{out_crs}")

buildings_scan_pts_gpd['z'] = buildings_pts[:,2]


print(buildings_scan_pts_gpd.head())
# ---------- end project ----------

# ---- group: Get tree points gpd
project_2 = Script(scan=lidar, out_crs=out_crs_6)  # -> tree_scan_pts_gpd, density, spacing
# ---------- project_2: Python ----------
import numpy as np
import geopandas as gpd
import rasterio as rio
import numpy as np
import laspy

buildings = laspy.create(
    point_format=scan.header.point_format, 
    file_version=scan.header.version)

points_to_calc = scan.points

print(scan.points.x.shape[0])

print(points_to_calc.x.shape[0])

width =  np.max(points_to_calc.x) - np.min(points_to_calc.x)
height = np.max(points_to_calc.y) - np.min(points_to_calc.y)

rt = scan.number_of_returns
rt2 = scan.return_number
over = scan.overlap
bbox_area = width * height

density = points_to_calc.x.shape[0] / bbox_area
spacing = 1 / np.sqrt(density)

buildings.points = scan.points[(scan.classification == 3) |
                               (scan.classification == 4) | 
                               (scan.classification == 5)]

buildings_pts = np.stack([buildings.points.x, 
                          buildings.points.y, 
                          buildings.points.z], axis=1)


tree_scan_pts_gpd = gpd.points_from_xy(buildings_pts[:,0], buildings_pts[:,1])


d = {'geometry': tree_scan_pts_gpd}
tree_scan_pts_gpd = gpd.GeoDataFrame(d, crs=f"EPSG:{out_crs}")

tree_scan_pts_gpd['z'] = buildings_pts[:,2]


print(tree_scan_pts_gpd.head())
# ---------- end project_2 ----------

# ----
item_4 = ListItem(List=dpath_2, Index=0, Wrap=True)
out_crs_7 = Integer(out_crs)

# ---- group: Extract and Cluster Trees
trees = Script(
    scan=lidar,
    min_cluster_size=Slider(100, range=0..1000),
    out_crs=out_crs_7,
    tree_level=item_4,
    translation=translation_3,
    sampling_density=Slider(1, range=0..1))  # -> mean_dists, all_leftover_points, a; inputs min_cluster_size: Int32, tree_level: Int32, translation: Vector3d, sampling_density: Double
# ---------- trees: Python ----------
import numpy as np
import geopandas as gpd
import rasterio as rio
import numpy as np
import laspy
import rhinoscriptsyntax as rs
import numpy as np
from sklearn import metrics
from sklearn.cluster import DBSCAN
import ghpythonlib.treehelpers as th
import Rhino
from scipy import spatial

vegetation_types = [
    3,# Low Vegetation
    4,# Medium Vegetation
    5 # High Vegetation
]

mean_dists = []
all_vegetation_clusters = []
all_leftover_points = []

for i in vegetation_types:

    trees = laspy.create(point_format=scan.header.point_format, file_version=scan.header.version)
    trees.points = scan.points[scan.classification == i]

    trees_pts = np.stack([trees.xyz[:,0] + translation.X,  
                          trees.xyz[:,1] + translation.Y, 
                          trees.xyz[:,2] + translation.Z], axis=1)

                        
    trees_scan_pts_gpd = gpd.points_from_xy(trees_pts[:,0], trees_pts[:,1])


    d = {'geometry': trees_scan_pts_gpd}

    trees_scan_pts_gpd = gpd.GeoDataFrame(d, crs=f"EPSG:{out_crs}")

    trees_scan_pts_gpd['z'] = trees_pts[:,2]


    X = np.stack([trees_scan_pts_gpd.geometry.x, 
                trees_scan_pts_gpd.geometry.y, 
                trees_scan_pts_gpd['z']], axis=1)

    # width =  np.max(trees_scan_pts_gpd.geometry.x) - np.min(trees_scan_pts_gpd.geometry.x)
    # height = np.max(trees_scan_pts_gpd.geometry.y) - np.min(trees_scan_pts_gpd.geometry.y)

    # bbox_area = width * height

    # density =  trees_scan_pts_gpd.shape[0] / bbox_area
    # spacing = 1.5 / np.sqrt(density)

            # find average spacing between points
    tree = spatial.KDTree(X)
    distance, index = tree.query(X, k=3)
    mean_dist = np.mean(distance[:,1:])
    mean_dists.append(mean_dist)
    if mean_dist < 0.01: 
        continue                

    # eps - The maximum distance between two samples for one to be 
    # considered as in the neighborhood of the other.
    # min_samples affects the minimum size of each cluster formed
    db = DBSCAN(eps=3 * mean_dist, min_samples=10).fit(X)
    labels = db.labels_

    # Number of clusters in labels, ignoring noise if present.
    n_clusters_ = len(set(labels)) - (1 if -1 in labels else 0)
    n_noise_ = list(labels).count(-1)

    print("Estimated number of clusters: %d" % n_clusters_)
    print("Estimated number of noise points: %d" % n_noise_)


    vegetation_clusters = []
    leftover_points = []
    unique_labels = set(labels)

    for k in unique_labels:
        class_member_mask = labels == k
        cluster_points = trees_scan_pts_gpd.iloc[class_member_mask]

        cluster = rs.AddPoints(
                np.stack([cluster_points.geometry.x,
                          cluster_points.geometry.y,
                          cluster_points.z], axis=1))

        if k == -1 or cluster_points.shape[0] < min_cluster_size:
            leftover_points.append(cluster)

        else:
            vegetation_clusters.append(cluster)



        
    all_leftover_points.append(leftover_points)
    all_vegetation_clusters.append(vegetation_clusters)

a = th.list_to_tree(all_vegetation_clusters, source=[tree_level])
all_leftover_points = th.list_to_tree(all_leftover_points, source=[tree_level])
# ---------- end trees ----------

# ----
tstat_3 = TreeStatistics(Tree=clean)  # -> Paths, Length, Count
density = Number(project.density)
spacing = Number(project.spacing)
branch = TreeBranch(Tree=simplify(buildings_osm.locations), Path=tstat_3.Paths, MaintainPaths=False)
branch_2 = TreeBranch(Tree=clean, Path=tstat_3.Paths, MaintainPaths=False)
buildings_gpd = Data(buildings_osm.buildings)
footprints = Curve(branch_2)
geo_locations = Number(branch)
tree_points = Point(trees.a)
buildings_scan_pts_gpd = Data(project.buildings_scan_pts_gpd)
tree_scan_pts_gpd = Data(project_2.tree_scan_pts_gpd)
tree_points_2 = Point(tree_points)
density_2 = Number(density)
spacing_2 = Number(spacing)

# ---- group: Alpha Wrap Roofs
# 3D Alpha Wrapping
py3 = Python3Script(points_tree=tree_points_2, density=density_2, spacing=spacing_2)  # -> mean_dists, b; inputs points_tree: tree of Point3d, density: Double, spacing: Double
# ---------- py3: Python ----------
import Rhino
import ghpythonlib.treehelpers as th
from CGAL import CGAL_Alpha_wrap_3
from CGAL.CGAL_Alpha_wrap_3 import Point_3_Vector
from CGAL.CGAL_Alpha_wrap_3 import Polygon_Vector
from CGAL.CGAL_Alpha_wrap_3 import Int_Vector
from CGAL.CGAL_Polyhedron_3 import Polyhedron_3
from CGAL import CGAL_Polygon_mesh_processing
from CGAL.CGAL_Kernel import Point_3
from CGAL.CGAL_Point_set_3 import Point_set_3
from CGAL.CGAL_Shape_detection import *
from CGAL.CGAL_Point_set_processing_3 import *
from CGAL.CGAL_Advancing_front_surface_reconstruction import *
from scipy import spatial
import rhinoscriptsyntax as rs
import geopandas as gpd
import numpy as np

import System
mean_dists = []
a = []
b = []
for points_t in th.tree_to_list(points_tree):
    a_ = []
    b_ = []
    if points_t is None: continue
    for points in points_t:
        if points is None: continue
        if len(points) < 4: 
            a.append([])
            continue
        points_set = Point_set_3()

        x_coords = []
        y_coords = []
        z_coords = []

        # Insertions
        for point_ in points:
            idx = points_set.insert(Point_3(point_.X, point_.Y, point_.Z))
            x_coords.append(point_.X)
            y_coords.append(point_.Y)
            z_coords.append(point_.Z)
        
        X = np.stack([x_coords, 
                      y_coords, 
                      z_coords], axis=1)

        # find average spacing between points
        tree = spatial.KDTree(X)
        distance, index = tree.query(X, k=3)
        mean_dist = np.mean(distance[:,1:])
        mean_dists.append(mean_dist)
        if mean_dist < 0.01: continue

        Q = Polyhedron_3()

        #advancing_front_surface_reconstruction(points_set, Q)

        # # # test with a point set as input
        CGAL_Alpha_wrap_3.alpha_wrap_3(list(points_set.points()), mean_dist*1.2, mean_dist, Q)


        mesh_points = {} 
        counter = 0
        for mesh_point in Q.points():
            mesh_points[(mesh_point.x(), mesh_point.y(), mesh_point.z())] = counter
            counter +=1
        mesh_faces = []
        for mesh_face in Q.facets():
            current_face = mesh_face.halfedge()

            p1 = (current_face.vertex().point().x(), 
                   current_face.vertex().point().y(), 
                    current_face.vertex().point().z())
            idx1 = mesh_points[p1]
            current_idx = -1
            ids = []
            ids.append(System.Int32(idx1))
            stopcounter = 0
            while stopcounter < 10:
                current_face = current_face.next()
                stopcounter += 1
                p2 = (current_face.vertex().point().x(), 
                      current_face.vertex().point().y(), 
                      current_face.vertex().point().z())
                current_idx = System.Int32(mesh_points[p2])
                if current_idx in ids:
                    break
                ids.append(System.Int32(current_idx))

            last = ids[-1]
            ids.append(last)

            mesh_faces.append(tuple(ids))

        test_cells = list(map(tuple, mesh_faces))
        test_points = list(map(tuple, mesh_points.keys()))

        b_.append(rs.AddMesh(test_points, test_cells))

    a.append(a_)
    b.append(b_)
a = th.list_to_tree(a)
b = th.list_to_tree(b)
# ---------- end py3 ----------

# ----
disjoint = DisjointMesh(Mesh=py3.b)
volume = MeshVolume(Mesh=disjoint)  # -> Volume, Centroid
smaller = SmallerThan(FirstNumber=volume.Volume, SecondNumber=Slider(7, range=0..10))  # -> SmallerThan, OrEqualTo
cull_2 = CullPattern(List=disjoint, CullPattern=invert(smaller.SmallerThan))
convquads = MeshConvertQuads(Mesh=cull_2, ShortDiagonal=True)  # -> Mesh, Split
rebmsh = RebuildMesh(
    Mesh=flatten(convquads.Mesh),
    RebuildNormals=Toggle(True),
    CullUnused=False,
    UnifyNormals=Toggle(True),
    FlipNormals=False,
    IdenticalCombine=False,
    WeldVertices=0)
mesh = Mesh(graft(rebmsh))
facen = FaceNormals(Mesh=mesh)  # -> Centers, Normals
Z = UnitZ(Factor=1)
explode = MeshExplode(Mesh=mesh, Interpolate=False)
dprod = DotProduct(VectorA=facen.Normals, VectorB=Z, Unitize=False)
larger = LargerThan(FirstNumber=dprod, SecondNumber=0)  # -> LargerThan, OrEqualTo
cull_3 = CullPattern(List=explode, CullPattern=larger.LargerThan)
lng = ListLength(List=cull_3)
multiplication = Multiplication(A=lng, B=Slider(0.5, range=0..1))
random = Random(Range=lng, Number=multiplication, Seed=2)
toggle = BooleanToggle(True)
int = Integer(random)
item_5 = ListItem(List=cull_3, Index=int, Wrap=True)
mjoin = MeshJoin(Meshes=item_5)
rebmsh_2 = RebuildMesh(
    Mesh=mjoin,
    RebuildNormals=Toggle(True),
    CullUnused=toggle,
    UnifyNormals=toggle,
    FlipNormals=False,
    IdenticalCombine=toggle,
    WeldVertices=Slider(0.0001, range=0..0.0001))
clean_2 = CleanTree(RemoveNulls=True, RemoveInvalid=True, RemoveEmpty=False, Tree=rebmsh_2)
tree_meshes = Mesh(clean_2)
toggle_2 = BooleanToggle(True)

# ---- group: NREL
nrel_weather_data_file_path_2 = FilePath("D:\GATECH\HPBL\Honeybee\Atlanta_33.77_-84.3824_2021.epw")

# ----
importepw = LBImportEPW(epw_file=nrel_weather_data_file_path_2)  # -> location, dry_bulb_temperature, dew_point_temperature, relative_humidity, wind_speed, wind_direction, direct_normal_rad, diffuse_horizontal_rad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; plug-in component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
number_slider = Slider(3, range=0..10)
number_slider_2 = Slider(11, range=0..100)
addition = Addition(A=number_slider_2, B=1)
addition_2 = Addition(A=number_slider, B=1)

# ---- group: NO leaves time
analysisperiod = LBAnalysisPeriod(start_month=addition, start_day=1, start_hour=0, end_month=number_slider)  # -> period, hoys, dates; plug-in component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
# Step 5. Estimate Max Yearly DC
# Energy Production by PV configuration
skymatrix = LBCumulativeSkyMatrix(
    location=importepw.location,
    direct_rad=importepw.direct_normal_rad,
    diffuse_rad=importepw.diffuse_horizontal_rad,
    hoys=analysisperiod.hoys)  # -> report, sky_mtx; plug-in component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

# ---- group: leaves time
analysisperiod_2 = LBAnalysisPeriod(start_month=addition_2, start_day=1, start_hour=0, end_month=number_slider_2)  # -> period, hoys, dates; plug-in component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
skymatrix_2 = LBCumulativeSkyMatrix(
    location=importepw.location,
    direct_rad=importepw.direct_normal_rad,
    diffuse_rad=importepw.diffuse_horizontal_rad,
    hoys=analysisperiod_2.hoys)  # -> report, sky_mtx; plug-in component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

# ----
panel_5 = Panel("""15, 7, 135
79, 2, 162
202, 70, 120
244, 137, 71
239, 248, 33""")
col = Colour(panel_5)
legendpar = LBLegendParameters(colors=col, font="Times New Roman")  # -> leg_par; plug-in component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
Z_2 = UnitZ(Factor=1)
tree_meshes_2 = Mesh(tree_meshes)
tree_meshes_3 = Mesh(tree_meshes)
number_slider_3 = Slider(0.01, range=0..0.01)
number_slider_4 = Slider(1, range=0..1)
number_slider_5 = Slider(0.01, range=0..0.01)
number_slider_6 = Slider(1, range=0..1)
Z_3 = UnitZ(Factor=1)
toggle_3 = BooleanToggle(True)

# ----
# Solar panel
# Capacity
panel_6 = Panel("0.4")

number_slider_7 = Slider(1, range=0..10)
toggle_4 = BooleanToggle(True)
footprints_2 = Curve(footprints)

# ----
# Solar API
# Panel Height
panel_7 = Panel("1.045")

# ----
# Solar API
# Panel Width
panel_8 = Panel("1.879")

multiplication_2 = Multiplication(A=panel_8, B=panel_7)

# ---- group: Panel Area
num_2 = Number(multiplication_2)

num_3 = Number(num_2)

# ----
division = Division(A=panel_6, B=num_3)
panel_9 = Panel("D:\GATECH\HPBL\GitHub\Solar API\location_data_GH.csv")
footprints_3 = Curve(footprints)
boundary = BoundarySurfaces(Edges=footprints_3)
area = Area(Geometry=boundary)  # -> Area, Centroid
nullrep = ReplaceNulls(Items=area.Area, Replacements="0")  # -> Items, Count
panel_10 = Panel(nullrep.Items)
geo_locations_2 = Number(geo_locations)
item_6 = ListItem(List=geo_locations_2, Index=0, Wrap=True)  # -> simplify(Item), simplify(Item1)
range = Range(Domain=Domain(0, 1), Steps=4)
merge = Merge(
    Data1="maxArrayPanelsCount",
    Data2="maxArrayAreaMeters2",
    Data3="numSegments",
    Data4="maxSunshineHoursPerYear",
    Data5="totSunshineHoursPerYear",
    Data6="areaMeters2",
    Data7="groundAreaMeters2",
    Data8="maxYearlyEnergyDcKwh",
    Data9="numTreePointsInFootprint",
    Data10="footprinAreaMeters2",
    Data11="longitude",
    Data12="latitude")
merge_2 = Merge(
    Data1="fitted slope deviation [m]",
    Data2="reconstructed area ratio",
    Data3="reconstruction shrinkage [m]",
    Data4="vegetation overlap [num. pt/m²]",
    Data5="max total DC energy [kWh/year]",
    Data6="max PV panel count",
    Data7="max PV panel area",
    Data8="number of roof slopes",
    Data9="max cir",
    Data10="cumulative IR [kWh/year]",
    Data11="reconstructed roof area [m]",
    Data12="g area")
flip = FlipMatrix(Data=geo_locations_2)
merge_3 = Merge(Data1="x", Data2="y")
csv = CreateCSV(DataGridHeaders=merge_3, ValueTree=flip, Delimiter=",")
panel_11 = Panel(csv)
number_slider_8 = Slider(1, range=0..1)

# ----
# OSM
tree_scan_pts_gpd_2 = Data(tree_scan_pts_gpd)
buildings_scan_pts_gpd_2 = Data(buildings_scan_pts_gpd)
# Step 2. Filter Point Cloud by Classification
# Type and intersect with Footprints
buildings_gpd_2 = Data(buildings_gpd)
intersect = Python3Script(buildings_scan_pts_gpd=buildings_scan_pts_gpd_2, buildings=buildings_gpd_2)  # -> mapped_points_df, remaining_points_df
# ---------- intersect: Python ----------
import numpy as np
import scipy.spatial as spatial
import geopandas as gpd
import pandas as pd

points = np.stack([buildings_scan_pts_gpd.geometry.x, buildings_scan_pts_gpd.geometry.y], axis=1)

# point_tree = spatial.cKDTree(points)

mapped_points = {}

global_inersect = None

for i in range(buildings.shape[0]):
    #if i != 8: continue
    footprint = buildings.iloc[i].geometry
    
    #surrounding_points = point_tree.query_ball_point([footprint.centroid.x, footprint.centroid.y], footprint.area / 2)
    
    does_intersect = buildings_scan_pts_gpd.geometry.intersects(footprint)
    mapped_points[i] = buildings_scan_pts_gpd[does_intersect]

    if global_inersect is None:
        global_inersect = does_intersect
    else:
        global_inersect = np.logical_or(global_inersect, does_intersect)


mapped_points_df = gpd.GeoDataFrame(pd.concat(mapped_points.values(), keys=mapped_points.keys(), axis=0))
remaining_points_df = buildings_scan_pts_gpd[global_inersect == False]

print(mapped_points_df.shape)
print(buildings_scan_pts_gpd[global_inersect == True].shape)
# ---------- end intersect ----------
intersect_2 = Python3Script(tree_scan_pts_gpd=tree_scan_pts_gpd_2, buildings=buildings_gpd_2)  # -> mapped_points_df, remaining_points_df
# ---------- intersect_2: Python ----------
import numpy as np
import scipy.spatial as spatial
import geopandas as gpd
import pandas as pd

points = np.stack([tree_scan_pts_gpd.geometry.x, tree_scan_pts_gpd.geometry.y], axis=1)

# point_tree = spatial.cKDTree(points)

mapped_points = {}

global_inersect = None

for i in range(buildings.shape[0]):
    #if i != 8: continue
    footprint = buildings.iloc[i].geometry
    
    #surrounding_points = point_tree.query_ball_point([footprint.centroid.x, footprint.centroid.y], footprint.area / 2)
    
    does_intersect = tree_scan_pts_gpd.geometry.intersects(footprint)
    mapped_points[i] = tree_scan_pts_gpd[does_intersect]

    if global_inersect is None:
        global_inersect = does_intersect
    else:
        global_inersect = np.logical_or(global_inersect, does_intersect)


mapped_points_df = gpd.GeoDataFrame(pd.concat(mapped_points.values(), keys=mapped_points.keys(), axis=0))
remaining_points_df = tree_scan_pts_gpd[global_inersect == False]

print(mapped_points_df.shape)
print(tree_scan_pts_gpd[global_inersect == True].shape)
# ---------- end intersect_2 ----------
py3_2 = Python3Script(mapped_points_df=intersect.mapped_points_df, buildings=buildings_gpd_2)  # -> buildings_points, buildings_heights
# ---------- py3_2: Python ----------
import numpy as np
import geopandas as gpd
import pandas as pd
import rhinoscriptsyntax as rs
import ghpythonlib.treehelpers as th

buildings_points = []
buildings_heights = []

indices = set(mapped_points_df.index.codes[0])

for i in range(buildings.shape[0]):
    if i not in indices:
        buildings_points.append([])
        buildings_heights.append(0)
    else:
        points = rs.AddPoints(np.stack([
            mapped_points_df.loc[i].geometry.x,
            mapped_points_df.loc[i].geometry.y,
            mapped_points_df.loc[i].z], axis=1))
        buildings_points.append(points)
        if "HEIGHT" in buildings.columns.tolist():
            buildings_heights.append(buildings.loc[i].HEIGHT)


buildings_points = th.list_to_tree(buildings_points)
# ---------- end py3_2 ----------
py3_3 = Python3Script(mapped_points_df=intersect_2.mapped_points_df, buildings=buildings_gpd_2)  # -> buildings_points, buildings_heights; same code as py3_2
translation_4 = Vector(translation)
translation_5 = Vector(translation)
translation_6 = Vector(translation)
move_3 = Move(Geometry=py3_2.buildings_points, Motion=translation_4)  # -> Geometry, Transform
move_4 = Move(Geometry=py3_3.buildings_points, Motion=translation_6)  # -> Geometry, Transform
branch_3 = TreeBranch(Tree=simplify(move_4.Geometry), Path=tstat_3.Paths, MaintainPaths=False)
branch_4 = TreeBranch(Tree=simplify(move_3.Geometry), Path=tstat_3.Paths, MaintainPaths=False)
path_mapper = PathMapper(branch_4, source="{A}", target="{0;A}")
tree_points_inside_footprints = Point(branch_3)
building_points_inside_footprints = Point(path_mapper)

# ---- group: Remaining Points
py3_4 = Python3Script(remainning_points_df=intersect.remaining_points_df)  # -> a
# ---------- py3_4: Python ----------
import numpy as np
import geopandas as gpd
import pandas as pd
import rhinoscriptsyntax as rs
import ghpythonlib.treehelpers as th


a = rs.AddPoints(np.stack([remainning_points_df.geometry.x,
                remainning_points_df.geometry.y,
                remainning_points_df.z], axis=1))
# ---------- end py3_4 ----------

# ----
move_5 = Move(Geometry=py3_4, Motion=translation_5)  # -> Geometry, Transform
building_points_outside_footprints = Point(move_5.Geometry)

# ----
# Step 3. Reconstruct Roof and Tree
# Geometry as 3D Meshes
building_points_inside_footprints_2 = Point(building_points_inside_footprints)
building_points = Point(building_points_inside_footprints_2)
building_points_2 = Point(building_points)

# ----
# DBSCAN
clean_3 = CleanTree(RemoveNulls=True, RemoveInvalid=True, RemoveEmpty=False, Tree=building_points_2)
density_3 = Number(density)
spacing_3 = Number(spacing)
py3_5 = Python3Script(points_tree=clean_3, density=density_3, spacing=spacing_3)  # -> a; inputs points_tree: tree of Point3d, density: Double, spacing: Double
# ---------- py3_5: Python ----------
import Rhino
import ghpythonlib.treehelpers as th
from sklearn import metrics
from sklearn.cluster import DBSCAN
import rhinoscriptsyntax as rs
import geopandas as gpd
import numpy as np
from scipy import spatial
a = []

for points in th.tree_to_list(points_tree):
    if len(points) == 0: 
        a.append([])
        continue
    
    points_array = np.array(points)

    x_coords = []
    y_coords = []
    z_coords = []

    # Insertions
    for point_ in points:
        x_coords.append(point_.X)
        y_coords.append(point_.Y)
        z_coords.append(point_.Z)

    X = np.stack([x_coords, 
                y_coords, 
                z_coords], axis=1)

    # # find average spacing between points
    # tree = spatial.KDTree(X)
    # distance, index = tree.query(X, k=4)
    # mean_dist = np.mean(distance[:,1:])

    # if mean_dist == np.inf:
    #     continue

    # eps - The maximum distance between two samples for one to be 
    # considered as in the neighborhood of the other.
    db = DBSCAN(eps=2*spacing, min_samples=10).fit(X)
    labels = db.labels_

    # Number of clusters in labels, ignoring noise if present.
    n_clusters_ = len(set(labels)) - (1 if -1 in labels else 0)
    n_noise_ = list(labels).count(-1)

    print("Estimated number of clusters: %d" % n_clusters_)
    print("Estimated number of noise points: %d" % n_noise_)


    a_ = []
    unique_labels = set(labels)

    for k in unique_labels:
        if k == -1:
            continue
        class_member_mask = labels == k
        if points_array[class_member_mask].shape[0] < 3:
            continue

        a_.append(points_array[class_member_mask].tolist())

    a.append(a_)

a = th.list_to_tree(a)
# ---------- end py3_5 ----------

# ---- group: Alpha Shae using mean distnace between all 6 neighbouring points
# Alpha shape 2
py3_6 = Python3Script(points_tree=py3_5)  # -> mean_dists, a, b; inputs points_tree: tree of Point3d
# ---------- py3_6: Python ----------
import Rhino
import ghpythonlib.treehelpers as th
from CGAL import CGAL_Alpha_wrap_3
from CGAL.CGAL_Alpha_wrap_3 import Point_3_Vector
from CGAL.CGAL_Alpha_wrap_3 import Polygon_Vector
from CGAL.CGAL_Alpha_wrap_3 import Int_Vector
from CGAL.CGAL_Polyhedron_3 import Polyhedron_3
from CGAL import CGAL_Polygon_mesh_processing
from CGAL.CGAL_Kernel import Point_3
from CGAL.CGAL_Point_set_3 import Point_set_3
from CGAL.CGAL_Shape_detection import *
from CGAL.CGAL_Point_set_processing_3 import *
from CGAL.CGAL_Advancing_front_surface_reconstruction import *
from CGAL.CGAL_Kernel import Point_2
from CGAL.CGAL_Kernel import Weighted_point_2
from CGAL.CGAL_Alpha_shape_2 import Alpha_shape_2
from CGAL.CGAL_Alpha_shape_2 import Weighted_alpha_shape_2
from CGAL.CGAL_Alpha_shape_2 import Weighted_alpha_shape_2_Face_handle
from CGAL.CGAL_Alpha_shape_2 import GENERAL, EXTERIOR, SINGULAR, REGULAR, INTERIOR
from CGAL.CGAL_Alpha_shape_2 import Alpha_shape_2_Vertex_handle
from CGAL.CGAL_Alpha_shape_2 import Alpha_shape_2_Face_handle
from CGAL.CGAL_Alpha_shape_2 import Face_Interval_3
from scipy import spatial
import rhinoscriptsyntax as rs
import geopandas as gpd
import numpy as np

import System

mean_dists = []
a = []
b = []
for points_t in th.tree_to_list(points_tree):
    a_ = []
    b_ = []
    if points_t is None: continue
    for points in points_t:
        if len(points) == 0: 
            a.append([])
            continue
        
        points_set = Point_set_3()
        lst = []
        z_dict = {}

        x_coords = []
        y_coords = []
        z_coords = []

        # Insertions
        for point_ in points:
            x_coords.append(point_.X)
            y_coords.append(point_.Y)
            z_coords.append(point_.Z)
            lst.append(Point_2(point_.X, point_.Y))
            z_dict[(point_.X, point_.Y)] = point_.Z
        
        X = np.stack([x_coords, 
                      y_coords, 
                      z_coords], axis=1)

        tree = spatial.KDTree(X)
        distance, index = tree.query(X, k=6)
        mean_dist = np.mean(distance[:,1:])
        a_.append(mean_dist)
        if mean_dist < 0.01: 
            continue  
        
        alpha = mean_dist * 2

        t = Alpha_shape_2(lst, EXTERIOR)
        t.clear()
        t.make_alpha_shape(lst)

        mesh_points = {} 
        rs_points = {} 
        counter = 0
        for mesh_point in t.points():
            mesh_points[(mesh_point.x(), mesh_point.y())] = counter
            rs_points[(mesh_point.x(), mesh_point.y())] = (mesh_point.x(), mesh_point.y(), z_dict[(mesh_point.x(), mesh_point.y())])
            counter +=1
        
        mesh_faces = []
        for f in t.finite_faces():
            if t.classify(f, alpha) == EXTERIOR:
                continue
            
            ids = []
            for i in range(3):
                p = t.triangle(f).vertex(i)
                idx = mesh_points[(p.x(), p.y())]
                ids.append(System.Int32(idx))


            mesh_faces.append(tuple(ids))

        test_cells = list(map(tuple, mesh_faces))
        test_points = rs_points.values()
        try:
            rs_mesh = rs.AddMesh(test_points, test_cells)
        except:
            continue

        rs.UnifyMeshNormals(rs_mesh)

        b_.append(rs_mesh)


    a.append(a_)
    b.append(b_)


a = th.list_to_tree(a)
b = th.list_to_tree(b)
# ---------- end py3_6 ----------

# ----
clean_4 = CleanTree(RemoveNulls=True, RemoveInvalid=True, RemoveEmpty=invert(False), Tree=py3_6.a)  # -> graft(Tree)
clean_5 = CleanTree(RemoveNulls=True, RemoveInvalid=True, RemoveEmpty=invert(False), Tree=py3_6.b)  # -> graft(Tree)
remesh = Remesh(Mesh=clean_5, FixEdges=True, EdgeLength=clean_4, Iterations=10, Project=True)
merge_4 = Merge(Data1=remesh, Data2=graft(py3_6.b))
item_7 = ListItem(List=merge_4, Index=0, Wrap=True)
clean_6 = CleanTree(RemoveNulls=True, RemoveInvalid=True, RemoveEmpty=False, Tree=item_7)
trim = TrimTree(Tree=clean_6, Depth=1)
disjoint_2 = DisjointMesh(Mesh=simplify(graft(trim)))
demesh = DeconstructMesh(Mesh=disjoint_2)  # -> Vertices, Faces, Colours, Normals
pdecon = Deconstruct(Point=demesh.Vertices)  # -> XComponent, YComponent, ZComponent
conmesh = ConstructMesh(Vertices=demesh.Vertices, Faces=demesh.Faces)  # -> simplify(Mesh)
lng_2 = ListLength(List=demesh.Vertices)
medges = MeshEdges(Mesh=conmesh)  # -> NakedEdges, InteriorEdges, NonManifoldEdges
bnd = Bounds(Numbers=pdecon.ZComponent)
line = Line(medges.NakedEdges)
dedomain = DeconstructDomain(Domain=bnd)  # -> Start, End
project_3 = Project(Geometry=line, Plane=PlaneXY(0, 0, 0))  # -> Geometry, Transform
trim_2 = TrimTree(Tree=simplify(dedomain.End), Depth="1")
join = JoinCurves(Curves=project_3.Geometry, Preserve=False)
runion = RegionUnion(Curves=join)
area_2 = Area(Geometry=runion)  # -> Area, Centroid
bnd_2 = Bounds(Numbers=trim_2)  # -> simplify(Domain)
sort = SortList(Keys=area_2.Area)  # -> Keys, ValuesA
dedomain_2 = DeconstructDomain(Domain=bnd_2)  # -> Start, End
item_8 = ListItem(List=reverse(sort.Keys), Index=0, Wrap=True)
subtraction = Subtraction(A=trim_2, B=dedomain_2.Start)  # -> graft(Result)
smaller_2 = SmallerThan(FirstNumber=subtraction, SecondNumber=Slider(9.4, range=0..100))  # -> SmallerThan, OrEqualTo
cull_4 = CullPattern(List=item_8, CullPattern=smaller_2.SmallerThan)
cull_5 = CullPattern(List=conmesh, CullPattern=smaller_2.SmallerThan)
larger_2 = LargerThan(FirstNumber=cull_4, SecondNumber=Slider(25, range=0..100))  # -> LargerThan, OrEqualTo
cull_6 = CullPattern(List=cull_4, CullPattern=larger_2.LargerThan)  # -> simplify(List)
cull_7 = CullPattern(List=cull_5, CullPattern=larger_2.LargerThan)
rebmsh_3 = RebuildMesh(
    Mesh=cull_7,
    RebuildNormals=Toggle(True),
    CullUnused=toggle_2,
    UnifyNormals=toggle_2,
    FlipNormals=False,
    IdenticalCombine=toggle_2,
    WeldVertices=Slider(0.0001, range=0..0.0001))
demesh_2 = DeconstructMesh(Mesh=rebmsh_3)  # -> Vertices, Faces, Colours, Normals
conmesh_2 = ConstructMesh(Vertices=demesh_2.Vertices, Faces=demesh_2.Faces, Colours=demesh_2.Normals)  # -> simplify(Mesh)
final_roofs = Mesh(conmesh_2)
pt_3 = Point(simplify(demesh_2.Vertices))
path_mapper_2 = PathMapper(pt_3, source="{A;B}", target="{0;A;B}")
path_mapper_3 = PathMapper(pt_3, source="{A}", target="{0;0;A}")
path_mapper_4 = PathMapper(pt_3, source="{A;B;C}", target="{0;A;B}")
path_mapper_5 = PathMapper(cull_6, source="{A;B}", target="{0;A;B}")
path_mapper_6 = PathMapper(cull_6, source="{A}", target="{0;0;A}")
path_mapper_7 = PathMapper(cull_6, source="{A;B;C}", target="{0;A;B}")
lng_3 = ListLength(List=flatten(path_mapper_2))
lng_4 = ListLength(List=flatten(path_mapper_5))
null = NullItem(Item=lng_3)  # -> NullFlags, InvalidFlags, Description
null_2 = NullItem(Item=lng_4)  # -> NullFlags, InvalidFlags, Description
filter = StreamFilter(Gate=null_2.NullFlags, Stream0=path_mapper_5, Stream1=path_mapper_6)
filter_2 = StreamFilter(Gate=null.NullFlags, Stream0=path_mapper_2, Stream1=path_mapper_3)
lng_5 = ListLength(List=flatten(filter))
lng_6 = ListLength(List=flatten(filter_2))
null_3 = NullItem(Item=lng_5)  # -> NullFlags, InvalidFlags, Description
null_4 = NullItem(Item=lng_6)  # -> NullFlags, InvalidFlags, Description
filter_3 = StreamFilter(Gate=null_4.NullFlags, Stream0=filter_2, Stream1=path_mapper_4)
filter_4 = StreamFilter(Gate=null_3.NullFlags, Stream0=filter, Stream1=path_mapper_7)
data = Data(filter_3)
data_2 = Data(filter_4)
panel_12 = Panel(data_2)
lng_7 = ListLength(List=data)

# ---- group: Point density per roof
division_2 = Division(A=lng_7, B=data_2)

# ----
sqrt = SquareRoot(Value=division_2)

# ---- group: Point spacing per roof
one_over_x = OneOverX(Value=sqrt)

# ----
spacings = Number(one_over_x)
densities = Number(division_2)
densities_2 = Number(densities)
spacings_2 = Number(spacings)
py3_7 = Python3Script(points_tree=data, densities=densities_2, spacings=spacings_2)  # -> a, b; inputs points_tree: tree of Point3d, densities: tree of Double, spacings: tree of Double
# ---------- py3_7: Python ----------
import Rhino
import ghpythonlib.treehelpers as th
from CGAL import CGAL_Alpha_wrap_3
from CGAL.CGAL_Alpha_wrap_3 import Point_3_Vector
from CGAL.CGAL_Alpha_wrap_3 import Polygon_Vector
from CGAL.CGAL_Alpha_wrap_3 import Int_Vector
from CGAL.CGAL_Polyhedron_3 import Polyhedron_3
from CGAL import CGAL_Polygon_mesh_processing
from CGAL.CGAL_Kernel import Point_3
from CGAL.CGAL_Point_set_3 import Point_set_3
from CGAL.CGAL_Shape_detection import *
from CGAL.CGAL_Point_set_processing_3 import *
from CGAL.CGAL_Advancing_front_surface_reconstruction import *
from scipy import spatial
import rhinoscriptsyntax as rs
import geopandas as gpd
import numpy as np

import System

a = []
b = []

for points_t, densities_t, spacings_t in zip(th.tree_to_list(points_tree), 
                                             th.tree_to_list(densities),
                                             th.tree_to_list(spacings)):
    a_ = []
    b_ = []

    if points_t is None:
        a_.append([[[]]])
        b_.append([[[]]])
        a.append(a_)
        b.append(b_)
        continue

    for points, density, spacing in zip(points_t, densities_t, spacings_t):
        if points is None or len(points) == 0: 
            a_.append([[]])
            b_.append([[]])
            continue
        points_set = Point_set_3()

        # x_coords = []
        # y_coords = []
        # z_coords = []

        # Insertions
        for point_ in points:
            idx = points_set.insert(Point_3(point_.X, point_.Y, point_.Z))
            # x_coords.append(point_.X)
            # y_coords.append(point_.Y)
            # z_coords.append(point_.Z)
        

        # X = np.stack([x_coords, 
        #             y_coords, 
        #             z_coords], axis=1)

        # find average spacing between points
        # tree = spatial.KDTree(X)
        # distance, index = tree.query(X, k=10)
        # mean_dist = np.mean(distance[:,1:])

        # if mean_dist == np.inf:
        #     continue

        points_set.add_normal_map()

            #print("Running jet_estimate_normals...")
        jet_estimate_normals(points_set, 10) # Use 10 neighbors

            #print("Running mst_orient_normals...")
        mst_orient_normals(points_set, 10) # Use 10 neighbors

        plane_map = points_set.add_int_map("plane_index") 

        mean_dist = spacing[0]
        eps = spacing[0] / 4 #/ density[0]

        planes = efficient_RANSAC(points_set,
                                    plane_map,
                                    epsilon=eps,
                                    cluster_epsilon=mean_dist,
                                    normal_threshold=eps,)

        points_map = {}
        idx_map = {}
        t = set([idx for idx in points_set.indices()])
        for idx in points_set.indices():
            if idx == 0 : continue
            group = plane_map.get(idx)
            if group not in points_map.keys():
                points_map[group] = []
            if group not in idx_map.keys():
                idx_map[group] = []
            rs_point = rs.AddPoint(points_set.point(idx).x(), 
                                points_set.point(idx).y(), 
                                points_set.point(idx).z())

            points_map[group].append(rs_point)
            idx_map[group].append(idx)


        a_.append([points_map[key] for key in points_map.keys()])
    a.append(a_)
    b.append(b_)
a = th.list_to_tree(a)
b = th.list_to_tree(b)
# ---------- end py3_7 ----------
plfit = PlaneFit(Points=py3_7.a)  # -> Plane, Deviation
deplane = DeconstructPlane(Plane=plfit.Plane)  # -> Origin, XAxis, YAxis, ZAxis
final_roofs_2 = Mesh(final_roofs)
dprod_2 = DotProduct(VectorA=deplane.ZAxis, VectorB=Z_2, Unitize=False)

# ---- group: Adv Roofs
# Slope Detection and Reconstruction
# Alpha shape 2
py3_8 = Python3Script(points_tree=py3_7.a)  # -> mean_dists, a, b; inputs points_tree: tree of Point3d
# ---------- py3_8: Python ----------
import Rhino
import ghpythonlib.treehelpers as th
from CGAL import CGAL_Alpha_wrap_3
from CGAL.CGAL_Alpha_wrap_3 import Point_3_Vector
from CGAL.CGAL_Alpha_wrap_3 import Polygon_Vector
from CGAL.CGAL_Alpha_wrap_3 import Int_Vector
from CGAL.CGAL_Polyhedron_3 import Polyhedron_3
from CGAL import CGAL_Polygon_mesh_processing
from CGAL.CGAL_Kernel import Point_3
from CGAL.CGAL_Point_set_3 import Point_set_3
from CGAL.CGAL_Shape_detection import *
from CGAL.CGAL_Point_set_processing_3 import *
from CGAL.CGAL_Advancing_front_surface_reconstruction import *
from CGAL.CGAL_Kernel import Point_2
from CGAL.CGAL_Kernel import Weighted_point_2
from CGAL.CGAL_Alpha_shape_2 import Alpha_shape_2
from CGAL.CGAL_Alpha_shape_2 import Weighted_alpha_shape_2
from CGAL.CGAL_Alpha_shape_2 import Weighted_alpha_shape_2_Face_handle
from CGAL.CGAL_Alpha_shape_2 import GENERAL, EXTERIOR, SINGULAR, REGULAR, INTERIOR
from CGAL.CGAL_Alpha_shape_2 import Alpha_shape_2_Vertex_handle
from CGAL.CGAL_Alpha_shape_2 import Alpha_shape_2_Face_handle
from CGAL.CGAL_Alpha_shape_2 import Face_Interval_3
from scipy import spatial
import rhinoscriptsyntax as rs
import geopandas as gpd
import numpy as np

import System

mean_dists = []
a = []
b = []
for points_t in th.tree_to_list(points_tree):
    a__ = []
    b__ = []
    if points_t is None:
        a_ = []
        b_ = []
        a__.append(a_)
        b__.append(b_)
        a.append(a__)
        b.append(b__)
        continue

    for points_t_ in points_t:
        a_ = []
        b_ = []
        if points_t_ is None: 
            a__.append(a_)
            b__.append(b_)
            continue
        
        for points in points_t_:
            if points is None: 
                a_.append([])
                continue
            if len(points) == 0: 
                a_.append([])
                continue
            
            points_set = Point_set_3()
            lst = []
            z_dict = {}

            x_coords = []
            y_coords = []
            z_coords = []

            # Insertions
            for point_ in points:
                x_coords.append(point_.X)
                y_coords.append(point_.Y)
                z_coords.append(point_.Z)
                lst.append(Point_2(point_.X, point_.Y))
                z_dict[(point_.X, point_.Y)] = point_.Z
            
            X = np.stack([x_coords, 
                        y_coords, 
                        z_coords], axis=1)

            tree = spatial.KDTree(X)
            distance, index = tree.query(X, k=6)
            mean_dist = np.mean(distance[:,1:])
            a_.append(mean_dist)
            if mean_dist < 0.01: 
                continue  
            
            alpha = mean_dist * 2

            t = Alpha_shape_2(lst, EXTERIOR)
            t.clear()
            t.make_alpha_shape(lst)

            mesh_points = {} 
            rs_points = {} 
            counter = 0
            for mesh_point in t.points():
                mesh_points[(mesh_point.x(), mesh_point.y())] = counter
                rs_points[(mesh_point.x(), mesh_point.y())] = (mesh_point.x(), mesh_point.y(), z_dict[(mesh_point.x(), mesh_point.y())])
                counter +=1
            
            mesh_faces = []
            for f in t.finite_faces():
                if t.classify(f, alpha) == EXTERIOR:
                    continue
                
                ids = []
                for i in range(3):
                    p = t.triangle(f).vertex(i)
                    idx = mesh_points[(p.x(), p.y())]
                    ids.append(System.Int32(idx))


                mesh_faces.append(tuple(ids))

            test_cells = list(map(tuple, mesh_faces))
            test_points = rs_points.values()
            try:
                rs_mesh = rs.AddMesh(test_points, test_cells)
            except:
                b_.append(None)
                
                continue

            rs.UnifyMeshNormals(rs_mesh)

            b_.append(rs_mesh)
        
        a__.append(a_)
        b__.append(b_)

    a.append(a__)
    b.append(b__)

a = th.list_to_tree(a)
b = th.list_to_tree(b)
# ---------- end py3_8 ----------

# ----
smaller_3 = SmallerThan(FirstNumber=dprod_2, SecondNumber=0)  # -> SmallerThan, OrEqualTo

# ---- group: Input
clean_7 = CleanTree(RemoveNulls=True, RemoveInvalid=True, RemoveEmpty=False, Tree=flatten(final_roofs_2))

# ----
toggle_5 = BooleanToggle(True)
incidentradiation = LBIncidentRadiation(
    sky_mtx=skymatrix.sky_mtx,
    geometry=flatten(clean_7),
    grid_size=number_slider_6,
    offset_dist=number_slider_5,
    legend_par=legendpar,
    run=toggle_5)  # -> report, points, results, total, mesh, legend, title, int_mtx; plug-in component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
incidentradiation_2 = LBIncidentRadiation(
    sky_mtx=skymatrix_2.sky_mtx,
    geometry=flatten(clean_7),
    context=flatten(tree_meshes_2),
    grid_size=number_slider_6,
    offset_dist=number_slider_5,
    legend_par=legendpar,
    run=toggle_5)  # -> report, points, results, total, mesh, legend, title, int_mtx; plug-in component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
mesh_2 = Mesh(incidentradiation_2.mesh)
addition_3 = Addition(A=incidentradiation.results, B=incidentradiation_2.results)
faceb = FaceBoundaries(Mesh=final_roofs_2)
faceb_2 = FaceBoundaries(Mesh=mesh_2)
area_3 = Area(Geometry=faceb_2)  # -> Area, Centroid
area_4 = Area(Geometry=faceb)  # -> Area, Centroid
rtree = CreateRTree(InputGeometry=area_3.Centroid)
rtree_cp = RTreeClosestPoint(SearchPoints=area_4.Centroid, RTree=rtree)  # -> ClosestPoint, ClosestIndex
num_4 = Number(addition_3)
tstat_4 = TreeStatistics(Tree=area_4.Centroid)  # -> Paths, Length, Count
item_9 = ListItem(List=num_4, Index=rtree_cp.ClosestIndex, Wrap=True)
item_10 = ListItem(List=faceb_2, Index=rtree_cp.ClosestIndex, Wrap=True)
dispatch = Dispatch(List=tstat_4.Paths, DispatchPattern=tstat_4.Length)  # -> ListA, ListB
partition = PartitionList(List=addition_3, Size=1)
branch_5 = TreeBranch(Tree=area_4.Centroid, Path=dispatch.ListB, MaintainPaths=True)
demesh_3 = DeconstructMesh(Mesh=mesh_2)  # -> Vertices, Faces, Colours, Normals
bar_graph = BarGraph(addition_3, BarColor=RGB(255, 0, 90))
repeat = RepeatData(Data=partition, Length=3)  # -> flatten(Data)
merge_5 = Merge(Data1=item_10, Data2=branch_5)
bnd_3 = Bounds(Numbers=repeat)
match = MatchTree(Tree=merge_5, Guide=faceb)
dedomain_3 = DeconstructDomain(Domain=bnd_3)  # -> Start, End
trim_3 = TrimTree(Tree=simplify(match), Depth=number_slider_7)
gradient = Gradient(
    LowerLimit=dedomain_3.Start,
    UpperLimit=dedomain_3.End,
    Parameter=repeat,
    stops=[0: RGB(15, 7, 135), 0.255: RGB(79, 2, 162), 0.498: RGB(202, 70, 120), 0.753: RGB(244, 137, 71), 1: RGB(239, 248, 33)])
tstat_5 = TreeStatistics(Tree=trim_3)  # -> Paths, Length, Count
item_11 = ListItem(List=tstat_5.Paths, Index=Slider(0, range=0..100), Wrap=True)
conmesh_3 = ConstructMesh(Vertices=demesh_3.Vertices, Faces=demesh_3.Faces, Colours=gradient)
branch_6 = TreeBranch(Tree=trim_3, Path=item_11, MaintainPaths=True)
disjoint_3 = DisjointMesh(Mesh=conmesh_3)
weld = WeldMesh(Mesh=graft(disjoint_3), Angle=3.141592654)

cull_8 = CullPattern(List=plfit.Plane, CullPattern=smaller_3.SmallerThan)
cull_9 = CullPattern(List=plfit.Plane, CullPattern=invert(smaller_3.SmallerThan))
flippln = FlipPlane(Plane=cull_9, FlipX=False, FlipY=False, FlipZ=True)  # -> Flipped, R
clean_8 = CleanTree(RemoveNulls=True, RemoveInvalid=True, RemoveEmpty=False, Tree=flippln.Flipped)
mesh_3 = Mesh(graft(py3_8.b))
merge_6 = Merge(Data1=cull_8, Data2=clean_8)
facen_2 = FaceNormals(Mesh=mesh_3)  # -> Centers, Normals
explode_2 = MeshExplode(Mesh=mesh_3, Interpolate=False)
data_3 = Data(simplify(graft(py3_8.b)))
brec = BoundingRectangle(Geometry=py3_7.a, Plane=merge_6, Axis=0, Slide=0, Union=True)  # -> Bounding, DimensionX, DimensionY
dprod_3 = DotProduct(VectorA=facen_2.Normals, VectorB=Z_3, Unitize=False)
tstat_6 = TreeStatistics(Tree=simplify(data_3))  # -> Paths, Length, Count
larger_3 = LargerThan(FirstNumber=dprod_3, SecondNumber=0)  # -> LargerThan, OrEqualTo
cull_10 = CullPattern(List=explode_2, CullPattern=larger_3.LargerThan)
mjoin_2 = MeshJoin(Meshes=cull_10)
match_2 = MatchTree(Tree=data_3, Guide=simplify(brec.Bounding))
rebmsh_4 = RebuildMesh(
    Mesh=match_2,
    RebuildNormals=Toggle(True),
    CullUnused=toggle_3,
    UnifyNormals=toggle_3,
    FlipNormals=False,
    IdenticalCombine=toggle_3,
    WeldVertices=Slider(0.0001, range=0..0.0001))
demesh_4 = DeconstructMesh(Mesh=rebmsh_4)  # -> Vertices, Faces, Colours, Normals
area_5 = MeshArea(Mesh=rebmsh_4)  # -> graft(Area), Centroid
area_6 = Area(Geometry=brec.Bounding)  # -> Area, Centroid
merge_7 = Merge(Data1=item_9, Data2=branch_5)
lng_8 = ListLength(List=demesh_4.Faces)
division_3 = Division(A=lng_8, B=area_6.Area)
panel_13 = Panel(lng_8)
match_3 = MatchTree(Tree=merge_7, Guide=faceb)
smaller_4 = SmallerThan(FirstNumber=division_3, SecondNumber=Slider(0.1, range=0..10))  # -> SmallerThan, OrEqualTo
trim_4 = TrimTree(Tree=simplify(match_3), Depth=number_slider_7)
cull_11 = CullPattern(List=graft(rebmsh_4), CullPattern=invert(smaller_4.SmallerThan))
cull_12 = CullPattern(List=graft(brec.Bounding), CullPattern=invert(smaller_4.SmallerThan))
branch_7 = TreeBranch(Tree=simplify(trim_4), Path=item_11, MaintainPaths=True)
project_4 = Project(Geometry=trim_3, Plane=PlaneXY(0, 0, 0))  # -> Geometry, Transform
area_7 = MeshArea(Mesh=cull_11)  # -> graft(Area), Centroid
bnd_4 = Bounds(Numbers=trim_4)
area_8 = Area(Geometry=trim_3)  # -> Area, Centroid
area_9 = Area(Geometry=project_4.Geometry)  # -> Area, Centroid
ma = MassAddition(Input=trim_4)  # -> Result, PartialResults
dedomain_4 = DeconstructDomain(Domain=bnd_4)  # -> Start, End
larger_4 = LargerThan(FirstNumber=area_7.Area, SecondNumber=Slider(4, range=0..10))  # -> LargerThan, OrEqualTo
ma_2 = MassAddition(Input=area_8.Area)  # -> Result, PartialResults
ma_3 = MassAddition(Input=area_9.Area)  # -> Result, PartialResults
cull_13 = CullPattern(List=graft(cull_11), CullPattern=larger_4.LargerThan)
cull_14 = CullPattern(List=graft(cull_12), CullPattern=larger_4.LargerThan)
drec_2 = DeconstuctRectangle(Rectangle=cull_14)  # -> BasePlane, XInterval, YInterval
demesh_5 = DeconstructMesh(Mesh=cull_13)  # -> Vertices, Faces, Colours, Normals
project_5 = Project(Geometry=demesh_5.Vertices, Plane=cull_14)  # -> Geometry, Transform
dedomain_5 = DeconstructDomain(Domain=drec_2.YInterval)  # -> Start, End
dedomain_6 = DeconstructDomain(Domain=drec_2.XInterval)  # -> Start, End
conmesh_4 = ConstructMesh(Vertices=project_5.Geometry, Faces=demesh_5.Faces)
abs = Absolute(Value=dedomain_6.Start)
abs_2 = Absolute(Value=dedomain_6.End)
abs_3 = Absolute(Value=dedomain_5.Start)
abs_4 = Absolute(Value=dedomain_5.End)
demesh_6 = DeconstructMesh(Mesh=conmesh_4)  # -> Vertices, Faces, Colours, Normals
addition_4 = Addition(A=abs_3, B=abs_4)
addition_5 = Addition(A=abs, B=abs_2)
# PV Panel Arrangement
rotate = Rotate(Geometry=cull_14, Angle=1.570796327, Plane=cull_14)  # -> Geometry, Transform
larger_5 = LargerThan(FirstNumber=addition_4, SecondNumber=addition_5)  # -> LargerThan, OrEqualTo
conmesh_5 = ConstructMesh(Vertices=demesh_6.Vertices, Faces=demesh_6.Faces, Colours=demesh_6.Normals)
cull_15 = CullPattern(List=cull_14, CullPattern=invert(larger_5.LargerThan))
cull_16 = CullPattern(List=rotate.Geometry, CullPattern=larger_5.LargerThan)
rebmsh_5 = RebuildMesh(
    Mesh=conmesh_5,
    RebuildNormals=Toggle(True),
    CullUnused=toggle_4,
    UnifyNormals=toggle_4,
    FlipNormals=False,
    IdenticalCombine=toggle_4,
    WeldVertices=0)
merge_8 = Merge(Data1=cull_15, Data2=cull_16)
final_roofs_3 = Mesh(final_roofs)
project_6 = Project(Geometry=final_roofs_3, Plane=PlaneXY(0, 0, 0))  # -> Geometry, Transform
slopes = Mesh(rebmsh_5)
clean_9 = CleanTree(RemoveNulls=True, RemoveInvalid=True, RemoveEmpty=invert(False), Tree=project_6.Geometry)

# ----
# RMSE orthogonal differences between
# roof plane and laser points
# [m]
number_slider_9 = Slider(2, range=0..10)
clean_10 = CleanTree(RemoveNulls=True, RemoveInvalid=True, RemoveEmpty=invert(False), Tree=plfit.Deviation)
pow = Power(A=clean_10, B=number_slider_9)  # -> flatten(Result)
sqr = Square(Value=clean_10)
panel_14 = Panel("1")
trim_5 = TrimTree(Tree=simplify(sqr), Depth=number_slider_9)
avr = Average(Input=trim_5)
ma_4 = MassAddition(Input=trim_5)  # -> Result, PartialResults
lng_9 = ListLength(List=trim_5)
division_4 = Division(A=ma_4.Result, B=lng_9)
sqrt_2 = SquareRoot(Value=division_4)
panel_15 = Panel(avr)

# ----
# Tree points inside footprint
# [num. points / m2]
tree_points_inside_footprints_2 = Point(tree_points_inside_footprints)
area_10 = Area(Geometry=footprints_2)  # -> Area, Centroid
lng_10 = ListLength(List=tree_points_inside_footprints_2)
ma_5 = MassAddition(Input=flatten(area_10.Area))  # -> Result, PartialResults
ma_6 = MassAddition(Input=flatten(lng_10))  # -> Result, PartialResults
division_5 = Division(A=lng_10, B=area_10.Area)
avr_2 = Average(Input=division_5)
panel_16 = Panel(avr_2)

# ----
# Average Shortest distance between corner points
# and laser points [m]
demesh_7 = DeconstructMesh(Mesh=clean_9)  # -> Vertices, Faces, Colours, Normals
trim_6 = TrimTree(Tree=simplify(demesh_7.Vertices), Depth=1)
tstat_7 = TreeStatistics(Tree=trim_6)  # -> Paths, Length, Count
branch_8 = TreeBranch(Tree=simplify(footprints_2), Path=tstat_7.Paths, MaintainPaths=True)
rtree_2 = CreateRTree(InputGeometry=trim_6)
explode_3 = Explode(Curve=branch_8, Recursive=True)  # -> Segments, Vertices
rtree_cp_2 = RTreeClosestPoint(SearchPoints=explode_3.Vertices, RTree=rtree_2)  # -> ClosestPoint, ClosestIndex
ln = Line(StartPoint=rtree_cp_2.ClosestPoint, EndPoint=flatten(explode_3.Vertices))
ln_2 = Line(StartPoint=flatten(explode_3.Vertices), EndPoint=rtree_cp_2.ClosestPoint)
match_4 = MatchTree(Tree=graft(ln_2), Guide=graft(explode_3.Vertices))  # -> simplify(Tree)
trim_7 = TrimTree(Tree=match_4, Depth=1)
len = Length(Curve=trim_7)
avr_3 = Average(Input=len)
panel_17 = Panel(avr_3)

# ----
# Fraction of misscflassified buildings
branch_9 = TreeBranch(Tree=simplify(footprints_2), Path=tstat_7.Paths, MaintainPaths=True)
tstat_8 = TreeStatistics(Tree=footprints_2)  # -> Paths, Length, Count
tstat_9 = TreeStatistics(Tree=branch_9)  # -> Paths, Length, Count
lng_11 = ListLength(List=tstat_8.Paths)
lng_12 = ListLength(List=tstat_9.Paths)
division_6 = Division(A=lng_12, B=lng_11)
panel_18 = Panel(division_6)

# ----
# Fraction of the building footprint area and
# projected reconstructed roof area
# tells us amount of area not containing points
area_11 = MeshArea(Mesh=clean_9)  # -> Area, Centroid
area_12 = Area(Geometry=branch_8)  # -> Area, Centroid
trim_8 = TrimTree(Tree=simplify(area_11.Area), Depth=1)
ma_7 = MassAddition(Input=area_12.Area)  # -> Result, PartialResults
ma_8 = MassAddition(Input=trim_8)  # -> Result, PartialResults
subtraction_2 = Subtraction(A=ma_7.Result, B=ma_8.Result)
division_7 = Division(A=ma_8.Result, B=ma_7.Result)
avr_4 = Average(Input=flatten(division_7))  # -> simplify(ArithmeticMean)
panel_19 = Panel(division_7)

cull_17 = CullPattern(List=addition_4, CullPattern=invert(larger_5.LargerThan))
cull_18 = CullPattern(List=addition_4, CullPattern=larger_5.LargerThan)
cull_19 = CullPattern(List=addition_5, CullPattern=invert(larger_5.LargerThan))
cull_20 = CullPattern(List=addition_5, CullPattern=larger_5.LargerThan)
merge_9 = Merge(Data1=cull_18, Data2=cull_19)
merge_10 = Merge(Data1=cull_17, Data2=cull_20)
slopes_2 = Mesh(simplify(slopes))
trim_9 = TrimTree(Tree=slopes_2, Depth=2)
division_8 = Division(A=merge_9, B=panel_8)

# ---- group: numSeg
lng_13 = ListLength(List=trim_9)

# ----
division_9 = Division(A=merge_10, B=panel_7)
panel_20 = Panel(lng_13)
equals = Equality(FirstNumber=lng_13, SecondNumber=1)  # -> Equality, Inequality
cull_21 = CullPattern(List=lng_13, CullPattern=invert(equals.Equality))
clean_11 = CleanTree(RemoveNulls=True, RemoveInvalid=True, RemoveEmpty=invert(False), Tree=cull_21)
round = Round(Number=division_8)  # -> Nearest, Floor, Ceiling
round_2 = Round(Number=division_9)  # -> Nearest, Floor, Ceiling

# ---- group: maxSunshineHoursPerYear
num_5 = Number(dedomain_4.End)

# ----
nullrep_2 = ReplaceNulls(Items=num_5, Replacements="0")  # -> Items, Count
clean_12 = CleanTree(RemoveNulls=True, RemoveInvalid=True, RemoveEmpty=invert(False), Tree=nullrep_2.Items)
panel_21 = Panel(nullrep_2.Items)
recgrid = Rectangular(Plane=merge_8, SizeX=panel_8, SizeY=panel_7, ExtentX=round.Floor, ExtentY=round_2.Floor)  # -> Cells, Points

# ---- group: totSunshineHoursPerYear
num_6 = Number(ma.Result)

# ----
nullrep_3 = ReplaceNulls(Items=num_6, Replacements="0")  # -> Items, Count
panel_22 = Panel(nullrep_3.Items)
clean_13 = CleanTree(RemoveNulls=True, RemoveInvalid=True, RemoveEmpty=invert(False), Tree=nullrep_3.Items)

# ---- group: areaMeters2
num_7 = Number(ma_2.Result)

# ----
nullrep_4 = ReplaceNulls(Items=num_7, Replacements="0")  # -> Items, Count
clean_14 = CleanTree(RemoveNulls=True, RemoveInvalid=True, RemoveEmpty=invert(False), Tree=nullrep_4.Items)
panel_23 = Panel(nullrep_4.Items)
nakededge = MeshNakedEdge(Mesh=rebmsh_5)  # -> V, A, B
trim_10 = TrimTree(Tree=recgrid.Cells, Depth=1)

# ---- group: groundAreaMeters2
num_8 = Number(ma_3.Result)

# ----
nullrep_5 = ReplaceNulls(Items=num_8, Replacements="0")  # -> Items, Count
panel_24 = Panel(nullrep_5.Items)
item_12 = ListItem(List=nakededge.V, Index=nakededge.A, Wrap=True)
clean_15 = CleanTree(RemoveNulls=True, RemoveInvalid=True, RemoveEmpty=invert(False), Tree=nullrep_5.Items)
item_13 = ListItem(List=nakededge.V, Index=nakededge.B, Wrap=True)
ln_3 = Line(StartPoint=item_12, EndPoint=item_13)
numtreepointsinfootprint = Number(avr_2)
nullrep_6 = ReplaceNulls(Items=numtreepointsinfootprint, Replacements="0")  # -> Items, Count
panel_25 = Panel(nullrep_6.Items)
clean_16 = CleanTree(RemoveNulls=True, RemoveInvalid=True, RemoveEmpty=False, Tree=trim_10)
brec_2 = BoundingRectangle(Geometry=clean_16, Plane=drec_2.BasePlane, Axis=0, Slide=0, Union=True)  # -> Bounding, DimensionX, DimensionY
join_2 = JoinCurves(Curves=ln_3, Preserve=False)
offset_l = OffsetCurveLoose(Curve=join_2, Distance="-0.25", Plane=cull_14)
drec_3 = DeconstuctRectangle(Rectangle=brec_2.Bounding)  # -> BasePlane, XInterval, YInterval
project_7 = Project(Geometry=offset_l, Plane=drec_2.BasePlane)  # -> Geometry, Transform
vec2pt_2 = Vector2Pt(PointA=drec_3.BasePlane, PointB=drec_2.BasePlane, Unitize=False)  # -> Vector, Length
move_6 = Move(Geometry=trim_10, Motion=vec2pt_2.Vector)  # -> Geometry, Transform

rmse = Panel(panel_15)
avg_frac_footprints_not_covered = Panel(panel_19)
avg_shortest_dist_to_corner = Panel(panel_17)
tree_points_inside_footprint = Panel(panel_16)
fac_of_missclassified_buldings = Panel(panel_18)

match_5 = MatchTree(Tree=project_7.Geometry, Guide=move_6.Geometry)
ccx = CurveCurve(CurveA=move_6.Geometry, CurveB=match_5)  # -> Points, ParamsA, ParamsB
clscrv = CloseCurve(Curve=match_5, CloseType=0, Bulge=0.5, Tolerance=0)  # -> Closed, R
lng_14 = ListLength(List=ccx.ParamsA)
equals_2 = Equality(FirstNumber=lng_14, SecondNumber=0)  # -> Equality, Inequality
trim_11 = TrimTree(Tree=equals_2.Equality, Depth=1)
cull_22 = CullPattern(List=move_6.Geometry, CullPattern=trim_11)
drec_4 = DeconstuctRectangle(Rectangle=move_6.Geometry)  # -> BasePlane, XInterval, YInterval
area_13 = Area(Geometry=cull_22)  # -> Area, Centroid
incurve = PointInCurve(Point=area_13.Centroid, Curve=clscrv.Closed)  # -> Relationship, Point
meshcp = MeshClosestPoint(Point=area_13.Centroid, Mesh=rebmsh_5)  # -> Point, Index, Parameter
dist = Distance(PointA=area_13.Centroid, PointB=meshcp.Point)
larger_6 = LargerThan(FirstNumber=dist, SecondNumber=Slider(0.5, range=0..1))  # -> LargerThan, OrEqualTo
cull_23 = CullPattern(List=cull_22, CullPattern=invert(larger_6.LargerThan))
mesh_uv = MeshSurface(Surface=cull_23, UCount=number_slider_8, VCount=number_slider_8, Overhang=True, Equalize=False)
flip_2 = MeshFlip(Mesh=mesh_uv)
trim_12 = TrimTree(Tree=simplify(flip_2), Depth=1)
solar_panels = Mesh(trim_12)
# Step 4. Calculate Annual Cumulative
# Incident Solar Radiation
solar_panels_2 = Mesh(solar_panels)

# ---- group: Input
clean_17 = CleanTree(RemoveNulls=True, RemoveInvalid=True, RemoveEmpty=False, Tree=flatten(solar_panels_2))

# ----
toggle_6 = BooleanToggle(True)
incidentradiation_3 = LBIncidentRadiation(
    sky_mtx=skymatrix.sky_mtx,
    geometry=flatten(clean_17),
    grid_size=number_slider_4,
    offset_dist=number_slider_3,
    legend_par=legendpar,
    run=toggle_6)  # -> report, points, results, total, mesh, legend, title, int_mtx; plug-in component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
incidentradiation_4 = LBIncidentRadiation(
    sky_mtx=skymatrix_2.sky_mtx,
    geometry=flatten(clean_17),
    context=flatten(tree_meshes_3),
    grid_size=number_slider_4,
    offset_dist=number_slider_3,
    legend_par=legendpar,
    run=toggle_6)  # -> report, points, results, total, mesh, legend, title, int_mtx; plug-in component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
mesh_4 = Mesh(incidentradiation_4.mesh)
addition_6 = Addition(A=incidentradiation_3.results, B=incidentradiation_4.results)
faceb_3 = FaceBoundaries(Mesh=mesh_4)
faceb_4 = FaceBoundaries(Mesh=solar_panels_2)
area_14 = Area(Geometry=faceb_3)  # -> Area, Centroid
area_15 = Area(Geometry=faceb_4)  # -> Area, Centroid
rtree_3 = CreateRTree(InputGeometry=area_14.Centroid)
rtree_cp_3 = RTreeClosestPoint(SearchPoints=area_15.Centroid, RTree=rtree_3)  # -> ClosestPoint, ClosestIndex
tstat_10 = TreeStatistics(Tree=area_15.Centroid)  # -> Paths, Length, Count
num_9 = Number(addition_6)
dispatch_2 = Dispatch(List=tstat_10.Paths, DispatchPattern=tstat_10.Length)  # -> ListA, ListB
item_14 = ListItem(List=num_9, Index=rtree_cp_3.ClosestIndex, Wrap=True)
item_15 = ListItem(List=faceb_3, Index=rtree_cp_3.ClosestIndex, Wrap=True)
partition_2 = PartitionList(List=addition_6, Size=1)
branch_10 = TreeBranch(Tree=area_15.Centroid, Path=dispatch_2.ListB, MaintainPaths=True)
demesh_8 = DeconstructMesh(Mesh=mesh_4)  # -> Vertices, Faces, Colours, Normals
bar_graph_2 = BarGraph(addition_6, BarColor=RGB(255, 0, 90))
repeat_2 = RepeatData(Data=partition_2, Length=4)  # -> flatten(Data)
merge_11 = Merge(Data1=item_15, Data2=branch_10)
bnd_5 = Bounds(Numbers=repeat_2)
match_6 = MatchTree(Tree=merge_11, Guide=faceb_4)
dedomain_7 = DeconstructDomain(Domain=bnd_5)  # -> Start, End
gradient_2 = Gradient(
    LowerLimit=dedomain_7.Start,
    UpperLimit=dedomain_7.End,
    Parameter=repeat_2,
    stops=[0: RGB(15, 7, 135), 0.255: RGB(79, 2, 162), 0.498: RGB(202, 70, 120), 0.753: RGB(244, 137, 71), 1: RGB(239, 248, 33)])
conmesh_6 = ConstructMesh(Vertices=demesh_8.Vertices, Faces=demesh_8.Faces, Colours=gradient_2)
disjoint_4 = DisjointMesh(Mesh=conmesh_6)
weld_2 = WeldMesh(Mesh=graft(disjoint_4), Angle=3.141592654)

area_16 = Area(Geometry=item_15)  # -> Area, Centroid
multiplication_3 = Multiplication(A=panel_6, B=item_14)
merge_12 = Merge(Data1=multiplication_3, Data2=branch_10)
multiplication_4 = Multiplication(A=item_14, B=division)
match_7 = MatchTree(Tree=merge_12, Guide=faceb_4)
path_mapper_8 = PathMapper(match_7, source=["{A;B;C;D;E}", "{A;B;C}"], target=["{A;B;C;D;E}", "{A;B;C;0;0}"])
path_mapper_9 = PathMapper(match_6, source=["{A;B;C;D;E}", "{A;B;C}"], target=["{A;B;C;D;E}", "{A;B;C;0;0}"])
trim_13 = TrimTree(Tree=simplify(path_mapper_8), Depth=3)

trim_14 = TrimTree(Tree=simplify(path_mapper_9), Depth=3)

area_17 = Area(Geometry=trim_14)  # -> Area, Centroid

# ---- group: maxYearlyEnergyDcKwh
ma_9 = MassAddition(Input=trim_13)  # -> Result, PartialResults

# ----
# Export Results and Evaluation Metrics
nullrep_7 = ReplaceNulls(Items=ma_9.Result, Replacements="0")  # -> Items, Count
clean_18 = CleanTree(RemoveNulls=True, RemoveInvalid=True, RemoveEmpty=invert(False), Tree=nullrep_7.Items)
panel_26 = Panel(nullrep_7.Items)

# ---- group: maxArrayPanelsCount
lng_15 = ListLength(List=area_17.Area)

# ----
equals_3 = Equality(FirstNumber=lng_15, SecondNumber=0)  # -> Equality, Inequality
cull_24 = CullPattern(List=lng_15, CullPattern=invert(equals_3.Equality))
clean_19 = CleanTree(RemoveNulls=True, RemoveInvalid=True, RemoveEmpty=invert(False), Tree=cull_24)
panel_27 = Panel(lng_15)

# ---- group: maxArrayAreaMeters2
ma_10 = MassAddition(Input=area_17.Area)  # -> Result, PartialResults

# ----
nullrep_8 = ReplaceNulls(Items=ma_10.Result, Replacements="0")  # -> Items, Count
clean_20 = CleanTree(RemoveNulls=True, RemoveInvalid=True, RemoveEmpty=invert(False), Tree=nullrep_8.Items)
panel_28 = Panel(nullrep_8.Items)
merge_13 = Merge(
    Data1=lng_15,
    Data2=nullrep_8.Items,
    Data3=lng_13,
    Data4=nullrep_2.Items,
    Data5=nullrep_3.Items,
    Data6=nullrep_4.Items,
    Data7=nullrep_5.Items,
    Data8=nullrep_7.Items,
    Data9=nullrep_6.Items,
    Data10=nullrep.Items,
    Data11=item_6.Item,
    Data12=item_6.Item1)
merge_14 = Merge(
    Data1=rmse,
    Data2=avg_frac_footprints_not_covered,
    Data3=avg_shortest_dist_to_corner,
    Data4=tree_points_inside_footprint,
    Data5=clean_18,
    Data6=clean_19,
    Data7=clean_20,
    Data8=clean_11,
    Data9=clean_12,
    Data10=clean_13,
    Data11=clean_14,
    Data12=clean_15)
flip_3 = FlipMatrix(Data=merge_13)
flip_4 = FlipMatrix(Data=merge_14)
csv_2 = CreateCSV(DataGridHeaders=merge, ValueTree=flip_3, Delimiter=",")
nullrep_9 = ReplaceNulls(Items=flip_4, Replacements="NaN")  # -> Items, Count
csv_3 = CreateCSV(DataGridHeaders=merge_2, ValueTree=nullrep_9.Items, Delimiter=",")
panel_29 = Panel(csv_2)
panel_30 = Panel(csv_3)
